% Simulink data dictionary dd_ControlAllocation.sldd
% references dd_GlobalShare.sldd
% references dd_IO.sldd
% references dd_Vehicle_E10.sldd

mode_frshift_derating_pCA = Simulink.Parameter(1, StorageClass="ExportedGlobal", DataType="uint8", Min=1, Max=4, Unit="1")  % Entscheidet, welcher Modus der sekundären Gewichtungsmatrix Anwendung in der Control Allocation findet.
  % zusätzlich zum Reibwertminimieren:
  % 1.. nichts
  % 2 .. manuelle Vorne-Hinten-Korrektur (für Korrektur Reifenerwärmung / NeutralSteer)
  % 3 ..  eine Vorentlastung einzelner Motoren stattfindet soll
  % 4 .. 2 & 4

mode_steer_pCA = Simulink.Parameter(1, StorageClass="ExportedGlobal", DataType="uint8", Min=1, Max=2, Unit="1")  % Auswahl, ob AVG oder einzelne Radlenkwinkel verwendet werden soll für die Berechnung der Effektivitätsmatrix in der Control Allocation E9

frontrearcorrection_temperature_pCA = Simulink.Parameter(0.5, StorageClass="ExportedGlobal", DataType="single", Min=0.2, Max=0.8, Unit="1")  % Standard Vorne-Hinten-Verteilung und Beeinflussungsmöglichkeit bei unterschiedlich schnell aufheizenden Reifen vorne und hinten.
  % 0.5  .. Keine Beeinflussung
  % 0     .. FWD, aber nur bis 0.2 gehen!
  % 1     .. RWD, aber nur bis 0.8 gehen!

Mz = Simulink.Signal(StorageClass="ExportedGlobal")
Fx = Simulink.Signal(StorageClass="ExportedGlobal")
TorqueRequest_minimalca = Simulink.Signal(StorageClass="ExportedGlobal")
breakpoints_motorspeed_efficiency_estim_pCA = Simulink.Parameter([48 1960 3950 5880 7870 9840 11780 13740 15710 17690 19640], StorageClass="ExportedGlobal", DataType="single", Unit="1/min")  % Stützstellen von Motor Speed des Effizienz-Kennfeldes von AMK DT5
overestimation_motor_effeciency_DT5_pCA = Simulink.Parameter([0.45 0.875 0.91 0.9225 0.928 0.934 0.94 0.945 0.95 0.955 0.96], StorageClass="ExportedGlobal", DataType="single", Unit="1")  % Überschätzte Motorwirkungsgrade: Maximum des Wirkungsgrads über alle stellbaren Momente für bestimmte Motordrehzahl (breakpoints_motorspeed_efficiency_overestim)
underestimation_motor_effeciency_DT5_pCA = Simulink.Parameter([0.0476 0.6192 0.7424 0.79 0.815 0.835 0.8475 0.855 0.86 0.865 0.87], StorageClass="ExportedGlobal", DataType="single", Unit="1")  % Unterschätzte Motorwirkungsgrade: Minimum des Wirkungsgrads über alle stellbaren Momente für bestimmte Motordrehzahl (breakpoints_motorspeed_efficiency_overestim)

OptParams = Simulink.Bus()  % Inputparameter für das Optimierungsproblem
  omega: double[4 1]
  W_v_tilde: double[2 1]
  eta: double[4 1]
  W_u_tilde: double[4 1]
  r_dyn: single
  lv: single
  a: single
  u_des: double[4 1]
  gamma: double
  zeta: double
  theta: double
  p_max: double
  p_max_recu: double
  enable_powerlimit_discharge: boolean
  enable_powerlimit_charge: boolean

enable_powerlimit_discharge_pCA = Simulink.Parameter(0, StorageClass="ExportedGlobal", DataType="boolean", Min=0, Max=1, Unit="1")
enable_powerlimit_charge_pCA = Simulink.Parameter(0, StorageClass="ExportedGlobal", DataType="boolean", Min=0, Max=1, Unit="1")

ignore_wheelangle_pCA = Simulink.Parameter(0, StorageClass="ExportedGlobal", DataType="boolean", Min=0, Max=1)  % 0 .. normal WheelAngle for ControlAllocation
  % 1 .. zero

mode_adhesion_pCA = Simulink.Parameter(1, StorageClass="ExportedGlobal", DataType="uint8", Min=1, Max=3, Unit="1")  % Betriebsmodus der Gewichtungsmatrix W_u.
  % Entscheidet darüber, ob Reifenkräfte die Verteilung der Radmomente auf die einzelnen Räder beeinflussen.
  % 1 .. Kräfte werden nicht berücksichtigt
  % 2 .. Kräfte werden berücksichtigt
  % 3 .. Gleichverteilungsmatrix

B_opt = Simulink.Signal(StorageClass="ExportedGlobal")
v_opt = Simulink.Signal(StorageClass="ExportedGlobal")
TorqueRequest_cvxgen = Simulink.Signal(StorageClass="ExportedGlobal")
W_v_tilde_opt = Simulink.Signal(StorageClass="ExportedGlobal")
W_u_tilde_opt = Simulink.Signal(StorageClass="ExportedGlobal")
ub_opt = Simulink.Signal(StorageClass="ExportedGlobal")
lb_opt = Simulink.Signal(StorageClass="ExportedGlobal")
u_des_opt = Simulink.Signal(StorageClass="ExportedGlobal")
gamma_opt = Simulink.Signal(StorageClass="ExportedGlobal")
zeta_opt = Simulink.Signal(StorageClass="ExportedGlobal")
theta_opt = Simulink.Signal(StorageClass="ExportedGlobal")
Pmax_opt = Simulink.Signal(StorageClass="ExportedGlobal")
Pmax_recu_opt = Simulink.Signal(StorageClass="ExportedGlobal")
enable_powerlimit_discharge_opt = Simulink.Signal(StorageClass="ExportedGlobal")
enable_powerlimit_charge_opt = Simulink.Signal(StorageClass="ExportedGlobal")
omega_opt = Simulink.Signal(StorageClass="ExportedGlobal")
eta_min_opt = Simulink.Signal(StorageClass="ExportedGlobal")
eta_max_opt = Simulink.Signal(StorageClass="ExportedGlobal")
DriveQualityFactor = Simulink.Signal(StorageClass="ExportedGlobal")
TorqueRequest_matalgo = Simulink.Signal(StorageClass="ExportedGlobal")
TorqueRequest_ca_unconstrained = Simulink.Signal(StorageClass="ExportedGlobal")
tireload_bias_pCA = Simulink.Parameter(200, StorageClass="ExportedGlobal", DataType="single")

skidpad_minimalmodel_distribution_pCA = Simulink.Parameter(3, StorageClass="ExportedGlobal", DataType="single")  % select front rear distribution, when minimal model 5 is running
  % range:
  % 1 .. 17% front
  % 2 .. 21% front
  % 3.. 23% front
  % 4 .. 25% front
  % 5 .. 30% front

panzerfaktor_yaw_pCA = Simulink.Parameter(2.2, StorageClass="ExportedGlobal", DataType="single", Min=1, Max=6)  % Yaw Moment gets multiplied by this factor with vd_button2 pressed
tireload_bias_dynamicbutton_pCA = Simulink.Parameter(400, StorageClass="ExportedGlobal", DataType="single")
motortemp_derating_ca_breakpoints_pCA = Simulink.Parameter([0 125 133 135], StorageClass="ExportedGlobal", DataType="single")  % [0 110 130 135] erster versuch
invertertemp_derating_ca_breakpoints_pCA = Simulink.Parameter([0 62 70 72], StorageClass="ExportedGlobal", DataType="single")  % [0 50 68 70] erster versuch
enable_torquelimit_grip_pCA = Simulink.Parameter(0, StorageClass="ExportedGlobal", DataType="boolean")

switch_opt_algo_pCA = Simulink.Parameter(1, StorageClass="ExportedGlobal", DataType="boolean")  % 0 = Matlab Algorithm
  % 1 = CVX Gen Algorithm

disable_ub_constraints_pCA = Simulink.Parameter(0, StorageClass="ExportedGlobal", DataType="boolean", Min=0, Max=1)
disable_lb_constraints_pCA = Simulink.Parameter(0, StorageClass="ExportedGlobal", DataType="boolean", Min=0, Max=1)

F_R_recu_distribution_pCA = Simulink.Parameter(0.72, StorageClass="ExportedGlobal", DataType="single")  % Front/Rear-Axle-Toruqe-Distribution for negative DriverDemand
  % Default: 0.72 on FrontAxle

skidpad_minimalmodel_distribution_pCA1 = Simulink.Parameter(5, StorageClass="ExportedGlobal", DataType="single")  % select front rear distribution, when minimal model 5 is running
  % range:
  % 1 .. 17% front
  % 2 .. 21% front
  % 3.. 23% front
  % 4 .. 25% front
  % 5 . default: variable parameter: F_R_distribution_pCA

TorqueRequest_ca_mini_E10 = Simulink.Signal(StorageClass="ExportedGlobal", DataType="single")
TorqueRequest_ca_opt_E10 = Simulink.Signal(StorageClass="ExportedGlobal", DataType="single")

F_R_distribution_pCA = Simulink.Parameter(0.23, StorageClass="ExportedGlobal", DataType="single")  % Front/Rear-Axle-Toruqe-Distribution for positive DriverDemand
  % Default: 0.4 on FrontAxle

torqueLimitation_E5_pCA = Simulink.Parameter(200, StorageClass="ExportedGlobal", DataType="single")  % torque limitation for the adjustment purpose to new vehicles from E5
max_AccTorque_E5_pCA = Simulink.Parameter(200, StorageClass="ExportedGlobal", DataType="single")  % max Acc-Torque at rear axel in miniCA E5 model in Saturation

enable_CA_E10_from_E9_pCA = Simulink.Parameter(0, StorageClass="ExportedGlobal", DataType="boolean")  % switch the signals of E10  to those of E9:
  % 1: E10
  % 0: E9

u_des_pCA = Simulink.Parameter([0; 0; 0; 0], StorageClass="ExportedGlobal", DataType="single")  % günstigster Stellvektor u: ist eigentlich immer zeros(4,1), weil am energiesparendsten und traktionsunkritischsten
gamma_pCA = Simulink.Parameter(10000, StorageClass="ExportedGlobal", DataType="single", Min=0, Unit="1")  % Gewichtungsfaktor primäre Zuordnung: Erfüllung des Fahrerwunschs

zeta_pCA = Simulink.Parameter(1000, StorageClass="ExportedGlobal", DataType="single", Min=0)  % Gewichtungsfaktor sekundäre Zuordnung:
  % Reduzierung der verwendeten Momente/ Reibschlusswerte/ Reibschlussausnutzungskoeffizienten,
  % je nach Gewichtungsmatrix

theta_pCA = Simulink.Parameter(1000, StorageClass="ExportedGlobal", DataType="single", Min=0)  % Gewichtungsfaktor sekundäre Zuordnung: rate limiter,
  % Glättung der angeforderten Momentenverläufe

scaling_factor_max_recutorque_pGL = Simulink.Parameter(0.7, StorageClass="ExportedGlobal", DataType="single")
bound_correction_pCA = Simulink.Parameter([0 0 1 1], StorageClass="ExportedGlobal", DataType="single")
eta_max_pCA = Simulink.Parameter([1; 1; 1; 1], StorageClass="ExportedGlobal", DataType="single", Min=0, Max=1, Unit="1")
eta_min_pCA = Simulink.Parameter([0; 0; 0; 0], StorageClass="ExportedGlobal", DataType="single", Min=0, Max=1, Unit="1")

w_v_lat_pCA = Simulink.Parameter(0.36, StorageClass="ExportedGlobal", DataType="single", Min=0.05, Max=50, Unit="1")  % Gewichtungsfaktor lateral - entscheidet, ob Fx oder Mz wichtiger ist.
  % Höher heißt: Lateraldynamik-Wunsch des Fahrers ist wichtiger.
  % w_v_lat * w_u_lat = 1 ist sehr wichtig, um Optimierung nicht zu verfälschen.

select_TorqueLimit_miniCA_pCA = Simulink.Parameter(1, StorageClass="ExportedGlobal", DataType="single")  % select torque upper and lower boundaries for miniCA models
  % 1..commbined torque limits
  % 2..TC torque limits

overundersteercorrection = Simulink.Signal()
MaxMotorTorque = Simulink.Signal()
MaxMotorTorque_front_ca = Simulink.Signal(StorageClass="ExportedGlobal")
MaxRecuMotorTorque_front_ca = Simulink.Signal(StorageClass="ExportedGlobal")

enable_manual_minimal_model_selection_pCA = Simulink.Parameter(1, StorageClass="ExportedGlobal")  % 0 - select the model via settings
  % 1 - enable to manually select the minimal model via 'select_minimal_model_pCA' (XCP)
  % (in DV eingeführt)

disable_motor_fl_pCA = Simulink.Parameter(1, StorageClass="ExportedGlobal", DataType="boolean")  % 0 - enable motor front left
  % 1 - disable motor front left

disable_motor_fr_pCA = Simulink.Parameter(1, StorageClass="ExportedGlobal", DataType="boolean")  % 0 - enable motor front right
  % 1 - disable motor front right

disable_motor_rl_pCA = Simulink.Parameter(0, StorageClass="ExportedGlobal", DataType="boolean")  % 0 - enable motor rear left
  % 1 - disable motor rear left

disable_motor_rr_pCA = Simulink.Parameter(0, StorageClass="ExportedGlobal", DataType="boolean")  % 0 - enable motor rear right
  % 1 - disable motor rear right

disable_motors_front_pCA = Simulink.Parameter(1, StorageClass="ExportedGlobal", DataType="boolean")  % Funktioniert nicht mehr ein E10 CA (?)
disable_motors_rear_pCA = Simulink.Parameter(0, StorageClass="ExportedGlobal", DataType="boolean")  % Funktioniert nicht mehr ein E10 CA (?)

disable_optimization_pCA = Simulink.Parameter(1, StorageClass="ExportedGlobal", DataType="boolean")  % 1 - Use minimal model
  % 0 - use optimized output

TorqueRequest_ca_opt_E9 = Simulink.Signal(StorageClass="ExportedGlobal", DataType="single", Dimensions=[4 1], InitialValue="0")  % Request of Torque by the cvxgen QP optimization algorithm, calculated at each time step
TorqueRequest_ca_out = Simulink.Signal(StorageClass="ExportedGlobal")
TorqueRequest_ca_mini_E9 = Simulink.Signal(StorageClass="ExportedGlobal")

select_minimal_model_pCA = Simulink.Parameter(2, StorageClass="ExportedGlobal", DataType="single", Min=1, Max=10)  % 1 .. distributaion between all Tires 33:66 and 66:33
  % 2 .. distributation based on accelerator and brake pedal postions
  % 3 .. distribution based on measured Tireloads
  % 4 .. RWD and normal braking
  % 5 .. manual selection at steering wheel on left turnbutton
  % 1.. miniCa_constantFWD
  % 2.. miniCa_constantRWD1
  % 3.. miniCa_constantAWD
  % 4.. miniCa_E5001
  % 5.. miniCa_E5
  % 6.. miniCa_Fx_des
  % 7.. miniCa_TireLoad
  % 8.. miniCA_constantAWD1
  % 9.. miniCA_sensorless
  % 19-08-2019 - changed to 2 (constant RWD)