% Simulink data dictionary dd_Environment.sldd

rho_air = Simulink.Parameter(1.204, DataType="single", Min=1.204, Max=1.204, Unit="kg/m^3")  % Luftdichte [kg/m^3]
g = Simulink.Parameter(9.81, DataType="single", Min=9.81, Max=9.81, Unit="m/s^2")  % Erdbeschleunigung