% Simulink data dictionary dd_FeedForwardControl.sldd
% references dd_ControlAllocation.sldd
% references dd_Environment.sldd
% references dd_GlobalShare.sldd
% references dd_IO.sldd
% references dd_PowerLimitation.sldd
% references dd_Vehicle_E10.sldd

frontrear_distribution_AWD_pFF = Simulink.Parameter(0.5, DataType="single", Min=0.5, Max=0.5, Unit="1")
frontrear_distribution_FWD_pFF = Simulink.Parameter(0.1, DataType="single", Min=0.1, Max=0.1, Unit="1")
frontrear_distribution_RWD_pFF = Simulink.Parameter(0.9, DataType="single", Min=0.9, Max=0.9, Unit="1")
DriverNotice = Simulink.Signal(StorageClass="ExportedGlobal")
enable_steervelgain_pFF = Simulink.Parameter(0, DataType="boolean")  % enables damping in BusStop situations for example
enable_yawrate_controller_pFF = Simulink.Parameter(0, StorageClass="ExportedGlobal", DataType="single", Unit="1")  % enable or disable yaw rate controller
steeranglegain_breakpoints_pFF = Simulink.Parameter(single([-110 -70 -5 0 5 70 110]), StorageClass="ExportedGlobal")
TVScalingFactor = Simulink.Signal(StorageClass="ExportedGlobal")

select_brakemap_type_pFF = Simulink.Parameter(1, StorageClass="ExportedGlobal", DataType="single", Min=1, Max=8)  % Select type of BrakeMap:
  % Choose between
  % 1 .. mu=1.7, P=72kW
  % 2 .. mu=1.7, P=60kW
  % 3 .. mu=1.7, P=50kW
  % 4 .. mu=1.1, P=72kW
  % 5 .. mu=1.1, P=60kW
  % 6 .. mu=1.1, P=50kW
  % 7 .. E8 BrakeMap
  % 8 .. 3 without Simulink-object

steeranglegain_data_pFF = Simulink.Parameter(single([-420 -390 -20 0 20 390 420]), StorageClass="ExportedGlobal")
steeranglegain_skidpad_breakpoints_pFF = Simulink.Parameter(single([-110 -70 -35 -5 0 5 35 70 110]), StorageClass="ExportedGlobal")  % single([-110 -70 -35 -5 0 5 35 70 110]) SkidPad linear
steeranglegain_skidpad_data_pFF = Simulink.Parameter(single([-84 -78 -39 -4 0 4 39 78 84]), StorageClass="ExportedGlobal")  % single([-84 -78 -39 -4 0 4 39 78 84]) Skidpad linear mit breakpoints:single([-110 -70 -35 -5 0 5 35 70 110])

BrakeMap_high_full = Simulink.LookupTable(
  Table=Simulink.lookuptable.Table(
    Value=[0 0 0 0 0 0 0 0 0 0 0 0 0 0 0 0 0 0 0 0 0 0 0 0 0
     0 0 164.95999 166.92 169.59999 173.08 177.31999 182.31999 188.12 194.67999 202 210.08 218.95999 228 212 197 185 174 165 156 148 141 135 129 123
     0 0 329.91998 333.84 339.19998 346.16 354.63998 364.63998 376.23999 389.35999 404 420.16 437.91998 456 423 395 370 349 329 312 296 282 269 258 247
     0 0 659.83997 667.67999 678.39996 692.32001 709.27997 729.27997 752.47998 778.71997 808 840.32001 875.83997 911 846 790 741 697 658 624 592 564 539 515 494
     0 0 989.75995 1001.52 1017.6 1038.48 1063.9199 1093.9199 1128.72 1168.08 1212 1260.48 1313.76 1367 1270 1185 1111 1046 987 935 889 846 808 773 741
     0 0 1402.16 1418.8201 1441.6 1471.1801 1507.22 1549.72 1599.02 1654.78 1717 1785.6801 1861.16 1937 1799 1679 1574 1481 1399 1325 1259 1199 1145 1095 1049
     0 0 2144.48 2169.96 2204.7998 2250.04 2305.1599 2370.1599 2445.5598 2530.8398 2626 2731.0398 2846.48 2962 2751 2567 2407 2265 2139 2027 1925 1834 1750 1674 1605
     0 0 2928.0398 2962.8298 3010.3999 3072.1699 3147.4299 3236.1799 3339.1299 3455.5698 3585.5 3728.9199 3886.5398 4045 3756 3505 3286 3093 2921 2767 2629 2504 2390 2286 2191
     0 0 3670.3599 3713.97 3773.5999 3851.03 3945.3699 4056.6199 4185.6699 4331.6299 4494.5 4674.2798 4871.8599 5070 4708 4394 4119 3877 3662 3469 3296 3139 2996 2866 2746
     0 0 4124 4173 4240 4327 4433 4558 4703 4867 5050 5252 5474 5697 5290 4937 4629 4356 4114 3898 3703 3527 3366 3220 3086
     0 0 4124 4173 4240 4327 4433 4558 4703 4867 5050 5252 5474 5697 5290 4937 4629 4356 4114 3898 3703 3527 3366 3220 3086],
    Dimensions=[11 25],
    FieldName="Table"),
  BreakpointsSpecification="Explicit values",
  Breakpoints=[Simulink.lookuptable.Breakpoint(
    Value=[0 0.1 0.2 0.3 0.4 0.5 0.6 0.7 0.8 0.9 1],
    TunableSizeName="N1",
    Dimensions=[1 11],
    FieldName="BP1"), Simulink.lookuptable.Breakpoint(
    Value=[0 5 10 15 20 25 30 35 40 45 50 55 60 65 70 75 80 85 90 95 100 105 110 115 120],
    TunableSizeName="N2",
    Dimensions=[1 25],
    FieldName="BP2")],
  StorageClass="ExportedGlobal")

BrakeMap_high_empty = Simulink.LookupTable(
  Table=Simulink.lookuptable.Table(
    Value=[0 0 0 0 0 0 0 0 0 0 0 0 0 0 0 0 0 0 0 0 0 0 0 0 0
     0 0 164.95999 166.92 169.59999 173.08 177.31999 182.31999 188.12 194.67999 202 210.08 206 190 176 165 154 145 137 130 123 118 112 107 103
     0 0 329.91998 333.84 339.19998 346.16 354.63998 364.63998 376.23999 389.35999 404 420.16 411 380 353 329 309 290 274 260 247 235 224 215 206
     0 0 659.83997 667.67999 678.39996 692.32001 709.27997 729.27997 752.47998 778.71997 808 840.32001 823 760 705 658 617 581 549 520 494 470 449 429 411
     0 0 989.75995 1001.52 1017.6 1038.48 1063.9199 1093.9199 1128.72 1168.08 1212 1260.48 1234 1139 1058 987 926 871 823 780 741 705 673 644 617
     0 0 1402.16 1418.8201 1441.6 1471.1801 1507.22 1549.72 1599.02 1654.78 1717 1785.6801 1749 1614 1499 1399 1311 1234 1166 1104 1049 999 954 912 874
     0 0 2144.48 2169.96 2204.7998 2250.04 2305.1599 2370.1599 2445.5598 2530.8398 2626 2731.0398 2674 2469 2292 2139 2006 1888 1783 1689 1605 1528 1459 1395 1337
     0 0 2928.0398 2962.8298 3010.3999 3072.1699 3147.4299 3236.1799 3339.1299 3455.5698 3585.5 3728.9199 3651 3371 3130 2921 2739 2577 2434 2306 2191 2087 1992 1905 1826
     0 0 3670.3599 3713.97 3773.5999 3851.03 3945.3699 4056.6199 4185.6699 4331.6299 4494.5 4674.2798 4577 4225 3923 3662 3433 3231 3051 2891 2746 2616 2497 2388 2289
     0 0 4124 4173 4240 4327 4433 4558 4703 4867 5050 5252 5143 4747 4408 4114 3857 3630 3429 3248 3086 2939 2805 2683 2571
     0 0 4124 4173 4240 4327 4433 4558 4703 4867 5050 5252 5143 4747 4408 4114 3857 3630 3429 3248 3086 2939 2805 2683 2571],
    Dimensions=[11 25],
    FieldName="Table"),
  BreakpointsSpecification="Explicit values",
  Breakpoints=[Simulink.lookuptable.Breakpoint(
    Value=[0 0.1 0.2 0.3 0.4 0.5 0.6 0.7 0.8 0.9 1],
    TunableSizeName="N1",
    Dimensions=[1 11],
    FieldName="BP1"), Simulink.lookuptable.Breakpoint(
    Value=[0 5 10 15 20 25 30 35 40 45 50 55 60 65 70 75 80 85 90 95 100 105 110 115 120],
    TunableSizeName="N2",
    Dimensions=[1 25],
    FieldName="BP2")],
  StorageClass="ExportedGlobal")

BrakeMap_high_safety = Simulink.LookupTable(
  Table=Simulink.lookuptable.Table(
    Value=[0 0 0 0 0 0 0 0 0 0 0 0 0 0 0 0 0 0 0 0 0 0 0 0 0
     0 0 164.95999 166.92 169.59999 173.08 177.31999 182.31999 188.12 194.67999 202 187 171 158 147 137 129 121 114 108 103 98 94 89 86
     0 0 329.91998 333.84 339.19998 346.16 354.63998 364.63998 376.23999 389.35999 404 374 343 316 294 274 257 242 229 217 206 196 187 179 171
     0 0 659.83997 667.67999 678.39996 692.32001 709.27997 729.27997 752.47998 778.71997 808 748 686 633 588 549 514 484 457 433 411 392 374 358 343
     0 0 989.75995 1001.52 1017.6 1038.48 1063.9199 1093.9199 1128.72 1168.08 1212 1122 1029 949 882 823 771 726 686 650 617 588 561 537 514
     0 0 1402.16 1418.8201 1441.6 1471.1801 1507.22 1549.72 1599.02 1654.78 1717 1590 1457 1345 1249 1166 1093 1029 971 920 874 833 795 760 729
     0 0 2144.48 2169.96 2204.7998 2250.04 2305.1599 2370.1599 2445.5598 2530.8398 2626 2431 2229 2057 1910 1783 1671 1573 1486 1408 1337 1273 1216 1163 1114
     0 0 2928.0398 2962.8298 3010.3999 3072.1699 3147.4299 3236.1799 3339.1299 3455.5698 3585.5 3319 3043 2809 2608 2434 2282 2148 2029 1922 1826 1739 1660 1588 1521
     0 0 3670.3599 3713.97 3773.5999 3851.03 3945.3699 4056.6199 4185.6699 4331.6299 4494.5 4161 3814 3521 3269 3051 2861 2692 2543 2409 2289 2180 2081 1990 1907
     0 0 4124 4173 4240 4327 4433 4558 4703 4867 5050 4675 4286 3956 3673 3429 3214 3025 2857 2707 2571 2449 2338 2236 2143
     0 0 4124 4173 4240 4327 4433 4558 4703 4867 5050 4675 4286 3956 3673 3429 3214 3025 2857 2707 2571 2449 2338 2236 2143],
    Dimensions=[11 25],
    DataType="single",
    FieldName="Table"),
  BreakpointsSpecification="Explicit values",
  Breakpoints=[Simulink.lookuptable.Breakpoint(
    Value=[0 0.1 0.2 0.3 0.4 0.5 0.6 0.7 0.8 0.9 1],
    TunableSizeName="N1",
    Dimensions=[1 11],
    FieldName="BP1"), Simulink.lookuptable.Breakpoint(
    Value=[0 5 10 15 20 25 30 35 40 45 50 55 60 65 70 75 80 85 90 95 100 105 110 115 120],
    TunableSizeName="N2",
    Dimensions=[1 25],
    FieldName="BP2")],
  StorageClass="ExportedGlobal")

BrakeMap_low_full = Simulink.LookupTable(
  Table=Simulink.lookuptable.Table(
    Value=[0 0 0 0 0 0 0 0 0 0 0 0 0 0 0 0 0 0 0 0 0 0 0 0 0
     0 0 106.75999 108 109.75999 112 114.72 117.96 121.71999 125.96 130.72 135.95999 141.67999 147.92 154.67999 161.87999 169.64 174 165 156 148 141 135 129 123
     0 0 213.51999 216 219.51999 224 229.44 235.92 243.43999 251.92 261.44 271.91998 283.35999 295.84 309.35999 323.75998 339.28 349 329 312 296 282 269 258 247
     0 0 427.03998 432 439.03998 448 458.88 471.84 486.87997 503.84 522.88 543.83997 566.71997 591.67999 618.71997 647.51996 678.56 697 658 624 592 564 539 515 494
     0 0 640.56 648 658.56 672 688.32001 707.76001 730.32001 755.76001 784.32001 815.76001 850.07996 887.51996 928.07996 971.27997 1017.84 1046 987 935 889 846 808 773 741
     0 0 907.46002 918 932.96002 952 975.12 1002.66 1034.62 1070.66 1111.12 1155.66 1204.28 1257.3201 1314.78 1375.98 1441.9401 1481 1399 1325 1259 1199 1145 1095 1049
     0 0 1387.88 1404 1426.88 1456 1491.36 1533.48 1582.36 1637.48 1699.36 1767.48 1841.84 1922.96 2010.84 2104.4399 2205.3198 2265 2139 2027 1925 1834 1750 1674 1605
     0 0 1894.99 1917 1948.24 1988 2036.2799 2093.79 2160.53 2235.79 2320.28 2413.29 2514.8198 2625.5798 2745.5698 2873.3699 3011.1099 3093 2921 2767 2629 2504 2390 2286 2191
     0 0 2375.4099 2403 2442.1599 2492 2552.52 2624.6099 2708.27 2802.6099 2908.52 3025.1099 3152.3799 3291.22 3441.6299 3601.8298 3774.49 3877 3662 3469 3296 3139 2996 2866 2746
     0 0 2669 2700 2744 2800 2868 2949 3043 3149 3268 3399 3542 3698 3867 4047 4241 4356 4114 3898 3703 3527 3366 3220 3086
     0 0 2669 2700 2744 2800 2868 2949 3043 3149 3268 3399 3542 3698 3867 4047 4241 4356 4114 3898 3703 3527 3366 3220 3086],
    Dimensions=[11 25],
    DataType="single",
    FieldName="Table"),
  BreakpointsSpecification="Explicit values",
  Breakpoints=[Simulink.lookuptable.Breakpoint(
    Value=[0 0.1 0.2 0.3 0.4 0.5 0.6 0.7 0.8 0.9 1],
    TunableSizeName="N1",
    Dimensions=[1 11],
    FieldName="BP1"), Simulink.lookuptable.Breakpoint(
    Value=[0 5 10 15 20 25 30 35 40 45 50 55 60 65 70 75 80 85 90 95 100 105 110 115 120],
    TunableSizeName="N2",
    Dimensions=[1 25],
    FieldName="BP2")],
  StorageClass="ExportedGlobal")

BrakeMap_low_empty = Simulink.LookupTable(
  Table=Simulink.lookuptable.Table(
    Value=[0 0 0 0 0 0 0 0 0 0 0 0 0 0 0 0 0 0 0 0 0 0 0 0 0
     0 0 106.75999 108 109.75999 112 114.72 117.96 121.71999 125.96 130.72 135.95999 141.67999 147.92 154.67999 161.87999 154 145 137 130 123 118 112 107 103
     0 0 213.51999 216 219.51999 224 229.44 235.92 243.43999 251.92 261.44 271.91998 283.35999 295.84 309.35999 323.75998 309 290 274 260 247 235 224 215 206
     0 0 427.03998 432 439.03998 448 458.88 471.84 486.87997 503.84 522.88 543.83997 566.71997 591.67999 618.71997 647.51996 617 581 549 520 494 470 449 429 411
     0 0 640.56 648 658.56 672 688.32001 707.76001 730.32001 755.76001 784.32001 815.76001 850.07996 887.51996 928.07996 971.27997 926 871 823 780 741 705 673 644 617
     0 0 907.46002 918 932.96002 952 975.12 1002.66 1034.62 1070.66 1111.12 1155.66 1204.28 1257.3201 1314.78 1375.98 1311 1234 1166 1104 1049 999 954 912 874
     0 0 1387.88 1404 1426.88 1456 1491.36 1533.48 1582.36 1637.48 1699.36 1767.48 1841.84 1922.96 2010.84 2104.4399 2006 1888 1783 1689 1605 1528 1459 1395 1337
     0 0 1894.99 1917 1948.24 1988 2036.2799 2093.79 2160.53 2235.79 2320.28 2413.29 2514.8198 2625.5798 2745.5698 2873.3699 2739 2577 2434 2306 2191 2087 1992 1905 1826
     0 0 2375.4099 2403 2442.1599 2492 2552.52 2624.6099 2708.27 2802.6099 2908.52 3025.1099 3152.3799 3291.22 3441.6299 3601.8298 3433 3231 3051 2891 2746 2616 2497 2388 2289
     0 0 2669 2700 2744 2800 2868 2949 3043 3149 3268 3399 3542 3698 3867 4047 3857 3630 3429 3248 3086 2939 2805 2683 2571
     0 0 2669 2700 2744 2800 2868 2949 3043 3149 3268 3399 3542 3698 3867 4047 3857 3630 3429 3248 3086 2939 2805 2683 2571],
    Dimensions=[11 25],
    DataType="single",
    FieldName="Table"),
  BreakpointsSpecification="Explicit values",
  Breakpoints=[Simulink.lookuptable.Breakpoint(
    Value=[0 0.1 0.2 0.3 0.4 0.5 0.6 0.7 0.8 0.9 1],
    TunableSizeName="N1",
    Dimensions=[1 11],
    FieldName="BP1"), Simulink.lookuptable.Breakpoint(
    Value=[0 5 10 15 20 25 30 35 40 45 50 55 60 65 70 75 80 85 90 95 100 105 110 115 120],
    TunableSizeName="N2",
    Dimensions=[1 25],
    FieldName="BP2")],
  StorageClass="ExportedGlobal")

BrakeMap_low_safety = Simulink.LookupTable(
  Table=Simulink.lookuptable.Table(
    Value=[0 0 0 0 0 0 0 0 0 0 0 0 0 0 0 0 0 0 0 0 0 0 0 0 0
     0 0 106.75999 108 109.75999 112 114.72 117.96 121.71999 125.96 130.72 135.95999 141.67999 147.92 147 137 129 121 114 108 103 98 94 89 86
     0 0 213.51999 216 219.51999 224 229.44 235.92 243.43999 251.92 261.44 271.91998 283.35999 295.84 294 274 257 242 229 217 206 196 187 179 171
     0 0 427.03998 432 439.03998 448 458.88 471.84 486.87997 503.84 522.88 543.83997 566.71997 591.67999 588 549 514 484 457 433 411 392 374 358 343
     0 0 640.56 648 658.56 672 688.32001 707.76001 730.32001 755.76001 784.32001 815.76001 850.07996 887.51996 882 823 771 726 686 650 617 588 561 537 514
     0 0 907.46002 918 932.96002 952 975.12 1002.66 1034.62 1070.66 1111.12 1155.66 1204.28 1257.3201 1249 1166 1093 1029 971 920 874 833 795 760 729
     0 0 1387.88 1404 1426.88 1456 1491.36 1533.48 1582.36 1637.48 1699.36 1767.48 1841.84 1922.96 1910 1783 1671 1573 1486 1408 1337 1273 1216 1163 1114
     0 0 1894.99 1917 1948.24 1988 2036.2799 2093.79 2160.53 2235.79 2320.28 2413.29 2514.8198 2625.5798 2608 2434 2282 2148 2029 1922 1826 1739 1660 1588 1521
     0 0 2375.4099 2403 2442.1599 2492 2552.52 2624.6099 2708.27 2802.6099 2908.52 3025.1099 3152.3799 3291.22 3269 3051 2861 2692 2543 2409 2289 2180 2081 1990 1907
     0 0 2669 2700 2744 2800 2868 2949 3043 3149 3268 3399 3542 3698 3673 3429 3214 3025 2857 2707 2571 2449 2338 2236 2143
     0 0 2669 2700 2744 2800 2868 2949 3043 3149 3268 3399 3542 3698 3673 3429 3214 3025 2857 2707 2571 2449 2338 2236 2143],
    Dimensions=[11 25],
    DataType="single",
    FieldName="Table"),
  BreakpointsSpecification="Explicit values",
  Breakpoints=[Simulink.lookuptable.Breakpoint(
    Value=[0 0.1 0.2 0.3 0.4 0.5 0.6 0.7 0.8 0.9 1],
    TunableSizeName="N1",
    Dimensions=[1 11],
    FieldName="BP1"), Simulink.lookuptable.Breakpoint(
    Value=[0 5 10 15 20 25 30 35 40 45 50 55 60 65 70 75 80 85 90 95 100 105 110 115 120],
    TunableSizeName="N2",
    Dimensions=[1 25],
    FieldName="BP2")],
  StorageClass="ExportedGlobal")

velgain_data_pFF = Simulink.Parameter([0 2 2 2 0.8 0.2 0 0 0 0 0 0 0 0 0 0 0 0 0 0], StorageClass="ExportedGlobal", DataType="single")  % [0 2 2 2 1 1 0.66 0.33 0 0 0 0 0 0 0 0 0 0 0 0] Pferdsfeld
  % [0 2 2 2 1 0.5 0 0 0 0 0 0 0 0 0 0 0 0 0 0] Pferdsfeld 2
  % [0 2 2 2 2 0.8 0.2 0 0 0 0 0 0 0 0 0 0 0 0 0] Pferdsfeld 3
  % [0 2.5 2.5 2.5 2.2 0.6 0.1 0 0 0 0 0 0 0 0 0 0 0 0 0] Pferdsfeld Freitag vor East

skiddetection_data_pFF = Simulink.Parameter(repmat(0, 21, 21), DataType="int8")  % Lookup Table for Anti Skid Block
enable_Fx_VelGain_acc_pFF = Simulink.Parameter(0, StorageClass="ExportedGlobal", DataType="boolean")  % switch for the acceleration Fx-VelGain look-up-table

select_F_R_dist_pFF = Simulink.Parameter(3, StorageClass="ExportedGlobal", DataType="single")  % select front/rear torque distribution:
  % 1..E5 lookup table
  % 2..E7 lookup table
  % 3..adjustible lookup table
  % 4..AccX-dependent

steervelocitygain_data_pFF = Simulink.Parameter([100 10 0 0 0 -10 -100], StorageClass="ExportedGlobal", DataType="single")
steervelocitygain_breakpoints_pFF = Simulink.Parameter([-140 -100 -60 0 60 100 140], StorageClass="ExportedGlobal", DataType="single")
throttlegain_data_pFF = Simulink.Parameter([0 0 0 0 0 0 0 0 0 0 1 1 1 1 1 1 1 1 1 1 1], StorageClass="ExportedGlobal", DataType="single")
throttlegain_breakpoints_pFF = Simulink.Parameter([-1 -0.9 -0.8 -0.7 -0.6 -0.5 -0.4 -0.3 -0.2 -0.1 0 0.1 0.2 0.3 0.4 0.5 0.6 0.7 0.8 0.9 1], StorageClass="ExportedGlobal", DataType="single")
velgain_breakpoints_pFF = Simulink.Parameter([0 2 4 6 8 10 12 14 16 18 20 22 24 26 28 30 32 34 36 38], StorageClass="ExportedGlobal", DataType="single")
skiddetection_yaw_breakpoints_pFF = Simulink.Parameter([-6.283185 -5.654867 -5.026548 -4.39823 -3.769911 -3.141593 -2.513274 -1.884956 -1.256637 -0.6283185 0 0.6283185 1.256637 1.884956 2.513274 3.141593 3.769911 4.39823 5.026548 5.654867 6.283185], DataType="single")  % Zeilenvektor für YawRate. Für Schwellwerterkennung im FF-Block
skiddetection_beta_breakpoints_pFF = Simulink.Parameter([-0.7853982 -0.7068583 -0.6283185 -0.5497787 -0.4712389 -0.3926991 -0.3141593 -0.2356194 -0.1570796 -0.07853982 0 0.07853982 0.1570796 0.2356194 0.3141593 0.3926991 0.4712389 0.5497787 0.6283185 0.7068583 0.7853982], DataType="single")  % Spaltenvektor der Aufspannpunkte für Schwellwert-Lookuptable für AntiSkidBlock
correctiontime_yawratecontrol_pFF = Simulink.Parameter(0.1, DataType="single", Unit="s")  % Taget timeframe in which any deficit/excess in yawrate is supposed to be corrected.
enable_FFC_E10_from_E9_pFF = Simulink.Parameter(0, StorageClass="ExportedGlobal", DataType="boolean")  % enable the E10 Feedforward Control Block from E9 Block
max_braking_force_factor_pFF = Simulink.Parameter(1, StorageClass="ExportedGlobal", DataType="single")  % the Amplification Factor of Longitudinal Braking Force
disable_SteerHook_factor_pFF = Simulink.Parameter(1, DataType="boolean")  % disable the SteerHook function from the referance one-track model for yaw moment control

mech_powerfactor_pFF = Simulink.Parameter(0.3, StorageClass="ExportedGlobal", DataType="single")  % Factor between electrical powerlimit (setpoint for normal PowerLimitation) and released P_mech = mech_powerfactor_pFF * P_el,
  % whereas the upper border of Fx: Fx = P_mech/v

dv_sdc_output = Simulink.Bus()
  sdc_acceleration_desired: double
  sdc_steering_desired: double
  sdc_yaw_moment_desired: double

dv_ecu_state = Simulink.Bus()
  dv_ecu_state_counter: double
  dv_ecu_state_cpu_temp: int16
  dv_ecu_state_crc_error_bl: double
  dv_ecu_state_error_sw: double
  dv_ecu_state_error: double
  dv_ecu_state_ok: double
  dv_ecu_state_state: double
  dv_ecu_state_warning: double
  dv_ecu_dv_vd_request_state_request: double

dv_VD_Diag_ff = Simulink.Signal(StorageClass="ExportedGlobal")
dv_OverUndersteerCorrection = Simulink.Signal(StorageClass="ExportedGlobal")
dv_Fx = Simulink.Signal(StorageClass="ExportedGlobal")
dv_Mz_scaled = Simulink.Signal(StorageClass="ExportedGlobal")
dv_vd_ecu_vehicle_state2 = Simulink.Signal(StorageClass="ExportedGlobal")