% Simulink data dictionary dd_GlobalShare.sldd

Sq_PosError = Simulink.Parameter(2, DataType="uint8")
Sq_PosTimeout = Simulink.Parameter(3, DataType="uint8")
Sq_PosHealth = Simulink.Parameter(4, DataType="uint8")
Sq_PosOutOfBounds = Simulink.Parameter(5, DataType="uint8")
Sq_PosBadGradient = Simulink.Parameter(6, DataType="uint8")
Sq_PosIsFrozen = Simulink.Parameter(7, DataType="uint8")
InverterStateInput = Simulink.Signal(StorageClass="ExportedGlobal")
InverterState_out = Simulink.Signal(StorageClass="ExportedGlobal")
different_tc_torque_rear_axis_pGL = Simulink.Parameter(0, StorageClass="ExportedGlobal", DataType="boolean")
different_tc_torque_front_axis_pGL = Simulink.Parameter(0, StorageClass="ExportedGlobal", DataType="boolean")
scaling_factor_max_torque_pGL = Simulink.Parameter(0.8, StorageClass="ExportedGlobal", DataType="single")  % due to inverter error 2334 at the AMK inverters and temperature on rear axis during endurance

max_velocity_pGL = Simulink.Parameter(32, StorageClass="ExportedGlobal", DataType="single", Min=15, Max=32, Unit="m/s")  % End-of-straight target speed for endurance. Used to prevent acceleration to inefficient speeds (as higher speeds offer
  % almost no laptime gains while using a lot more energy to overcome aero-drag).
  % Reasonable values should be anywhere between 22 and 30 m/s, range could potentially be even wider.

max_recu_current_pGL = Simulink.Parameter(120, StorageClass="ExportedGlobal", DataType="single", Unit="A")  % Maximal Current for Recuperation
TC_bit_pGL = Simulink.Parameter([0 1 2 3])
E9_ECU_Configuration = Simulink.ConfigSet(StartTime="0", StopTime="inf", Solver="FixedStepDiscrete", ProdHWDeviceType="Generic->32-bit x86 compatible", SystemTargetFile="slrt.tlc", TargetLang="C")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
TorqueWhileBrake_active_bit_pGL = Simulink.Parameter(17)
YawHook_bit_pGL = Simulink.Parameter(8)
VMax_active_bit_pGL = Simulink.Parameter(9)
YawRateControl_active_bit_pGL = Simulink.Parameter(10)
Skidding_active_bit_pGL = Simulink.Parameter(11)
FxNotReached_bit_pGL = Simulink.Parameter(12)  % Number of the bit for the PowerLimitation in VD_Diag
MzNotReached_bit_pGL = Simulink.Parameter(13)
MechPowerLimit_active_bit_pGL = Simulink.Parameter(14)
PowerLimit_active_bit_pGL = Simulink.Parameter(15)
Safety_active_bit_pGL = Simulink.Parameter(16)
InverterOutLimit_active_bit_pGL = Simulink.Parameter(18)
Sensor_Implausible_bit_pGL = Simulink.Parameter(19)
EKF_running_bit_pGL = Simulink.Parameter(20)
Bias_measurement_running_bit_pGL = Simulink.Parameter(21)
InvTC_active_FL_bit_pGL = Simulink.Parameter(22)
InvTC_active_FR_bit_pGL = Simulink.Parameter(23)
InvTC_active_RL_bit_pGL = Simulink.Parameter(24)
InvTC_active_RR_bit_pGL = Simulink.Parameter(25)
WrongTireTemp_FL_bit_pGL = Simulink.Parameter(26)
WrongTireTemp_FR_bit_pGL = Simulink.Parameter(27)
WrongTireTemp_RL_bit_pGL = Simulink.Parameter(28)
WrongTireTemp_RR_bit_pGL = Simulink.Parameter(29)
MotorLimit_bit_pGL = Simulink.Parameter([4 5 6 7])
Derating_Front_active_bit_pGL = Simulink.Parameter(30)
Derating_Rear_active_bit_pGL = Simulink.Parameter(31)

enable_simpleTireLoad_pGL = Simulink.Parameter(3, StorageClass="ExportedGlobal", DataType="single")  % This parameter enables the simple estimation of TireLoads (with ay ax).
  % If complex estimation is used then there is added a bias to the tireloads in CA.
  % Simple TireLoad estimation=1
  % Complex TireLoad estimation + TireLoad Biases in CA=0
  % if set to 2, the E8 tire load estimator is enabled, use switch_rocker_direction_pSF to adjust it to E9, if necessary.

GT2_recu_torque_limit_factor_pGl = Simulink.Parameter(1, StorageClass="ExportedGlobal", DataType="single", Min=0)  % The Factor for Recu Torque Limit for Adjusting from GT2 Motor Mapping to Inverter
GT2_torque_limit_factor_pGl = Simulink.Parameter(1, StorageClass="ExportedGlobal", Min=0)  % The Factor for Torque Limit for Adjusting from GT2 Motor Mapping to Inverter

enable_tv_pGL = Simulink.Parameter(0, StorageClass="ExportedGlobal", DataType="boolean", Min=0, Max=1, Unit="1")  % set 1 for enabling Torque Vectoring,
  % set 0 for having an Left right equal distributed vehicle
  % DV: set to 0

p_max_recu_pGL = Simulink.Parameter(-10000, StorageClass="ExportedGlobal", DataType="single", Unit="W")  % EV: -63000
  % DV: -35000

p_max_pGL = Simulink.Parameter(30000, StorageClass="ExportedGlobal", DataType="single", Min=0, Unit="W")  % maximal abrufbare Batterieleistung,
  % die wir im Beschleunigungsfall abrufen dürfen
  % EV: 80000
  % DV: 64000