% Simulink data dictionary dd_IO.sldd

control_TireParameters = Simulink.Bus()
  Bx_FL: single
  Bx_FR: single
  Bx_RL: single
  Bx_RR: single
  Ex_FL: single
  Ex_FR: single
  Ex_RL: single
  Ex_RR: single
  By_FL: single
  By_FR: single
  By_RL: single
  By_RR: single
  Ey_FL: single
  Ey_FR: single
  Ey_RL: single
  Ey_RR: single

control_9D = Simulink.Bus()
  AccX: single, Unit="m/s^2"
  AccY: single, Unit="m/s^2"
  AccZ: single, Unit="m/s^2"
  RollRate: single
  PitchRate: single
  YawRate: single
  MagX: single
  MagY: single
  MagZ: single
  Temperature: single
  AccX_Sq: uint8
  AccY_Sq: uint8
  AccZ_Sq: uint8
  RollRate_Sq: uint8
  PitchRate_Sq: uint8
  YawRate_Sq: uint8

control_Suspension = Simulink.Bus()
  RockerAngle_FL: single
  RockerAngle_FR: single
  RockerAngle_RL: single
  RockerAngle_RR: single
  RockerAngle_FL_Sq: uint8
  RockerAngle_FR_Sq: uint8
  RockerAngle_RL_Sq: uint8
  RockerAngle_RR_Sq: uint8

control_Electric = Simulink.Bus()
  BatSOC: uint8
  BatVoltage: single, Unit="V"
  BatPower: single, Unit="W"
  BatCurrent: single, Unit="A"
  AvgCellVoltage: single, Unit="mV"
  MaxCellVoltage: single, Unit="mV"
  MinCellVoltage: single, Unit="mV"
  IVTEnergy: single, Unit="W*h"
  MinCellTemp: single
  IVT_VoltageCurrent_Sq: uint8
  IVT_Energy_Sq: uint8
  HVM_BMS_Sq: uint8

control_DriverInput = Simulink.Bus()
  db_PTM: boolean
  db_button_low: boolean
  vd_button_1: boolean
  vd_button_2: boolean
  vd_turnbutton_1: single
  vd_turnbutton_2: single
  driver: uint8
  driving_mode: uint8
  DriverInput_Sq: uint8

control_Velocity = Simulink.Bus()
  SlipAngle: single
  VelY: single, Unit="m/s"
  VelX: single, Unit="m/s"
  SlipAngle_Sq: uint8
  VelY_Sq: uint8
  VelX_Sq: uint8
  valueIsNew: boolean

control_DriverRequest = Simulink.Bus()
  Pedal_BrakeMech_Value: single
  Pedal_BrakeRecu_Value: single
  SteeringwheelAngle: single, Unit="deg"
  Pedal_Accel_Value: single
  Pedal_TorqueValid_flag: boolean
  Pedal_BrakeHard_flag: boolean
  Pedal_BrakeMech_flag: boolean
  SteeringValid_flag: boolean
  Pedal_BrakeValid_flag: boolean
  SteeringwheelAngle_Sq: uint8
  Pedal_Accel_Value_Sq: uint8

control_SiL_Input = Simulink.Bus()
  SiL_enabled: boolean
  SiL_VehicleState: Bus: control_VehicleState
  SiL_WheelStates: Bus: control_WheelStates

control_WheelStates = Simulink.Bus()
  ReferenceWheelSpeed: single[4], Unit="rad/s"
  ReferenceWheelAcc: single[4], Unit="rad/(s^2)"
  TireSlipLong: single[4]
  TireSlipAngle: single[4]
  TireForceLong: single[4], Unit="N"
  TireForceLat: single[4], Unit="N"
  TireLoad: single[4]
  MaxFrictionCoeff: single[4]
  WheelAngle: single[4]

control_VehicleLogicState = Simulink.Bus()
  ReadyToDrive: boolean
  MotorActive: boolean[4]
  SystemState: single

control_Settings = Simulink.Bus()
  PMax: single, Min=0, Max=80000, Unit="W"
  PMaxRecuperation: single, Min=0, Max=75000, Unit="W"
  VMax: single, Min=0, Max=32, Unit="m/s"
  DebugOn: boolean
  DisableMotorsFront: boolean
  DisableMotorsRear: boolean
  ConstantSlipPercent: single, Min=0, Max=0.25
  ConstantBrakeSlipPercent: single, Min=0, Max=0.2
  TractionControlMode: uint8, Min=0, Max=2
  maxMotorSpeed: single, Min=0, Max=5000, Unit="1/min"  % muss noch in der PowerLimitation zugeordnet werden. Stadnard ist 5000
  FrontReadDistFactor: single
  Lyap_kp: single, Min=0, Max=150
  velLimitInput: single, Min=0, Max=5, Unit="m/s"
  lyapFilterCoeff: single, Min=-0.97, Max=0
  scaling_factor_max_torque: single, Min=0, Max=1
  scaling_factor_max_recutorque: single, Min=0, Max=1
  TWB_off: boolean
  disable9Drear: boolean
  lambda_mux: single
  sensorlessmode: boolean
  mechPowerlimit: single
  select_minimal_model: single

control_VehicleState = Simulink.Bus()
  PosX: single
  PosY: single
  VelX: single
  VelY: single
  YawAngle: single
  YawRate: single
  YawAcc: single
  AccX: single
  AccY: single
  AccZ: single
  isDriving: boolean