% Simulink data dictionary dd_MainControl.sldd
% references dd_ControlAllocation.sldd
% references dd_FeedForwardControl.sldd
% references dd_GlobalShare.sldd
% references dd_IO.sldd
% references dd_PowerLimitation.sldd
% references dd_Safety.sldd
% references dd_SensorFusion.sldd
% references dd_TractionControl.sldd
% references dd_Vehicle_E10.sldd

TireLoad = Simulink.Signal(StorageClass="ExportedGlobal", DataType="single", Dimensions=4)
is9Ddisabled = Simulink.Signal(StorageClass="ExportedGlobal", DataType="boolean")
BrakeMapX = Simulink.Parameter(single([0 0.1 0.2 0.3 0.4 0.5 0.6 0.7 0.8 0.9 1]), StorageClass="ExportedGlobal")
BrakeMapData_PhBo = Simulink.Parameter([0 0.01 0.04 0.09 0.16 0.25 0.36 0.49 0.64 0.81 1], StorageClass="ExportedGlobal", DataType="single")
mask_select_input_pGL = Simulink.Parameter(0, StorageClass="ExportedGlobal", DataType="uint32")

disable_slipanglesensor = Simulink.Parameter(0, StorageClass="ExportedGlobal", DataType="boolean")  % This parameter disables the slipangle-sensor. That means if sensor is disabled the value of the sensor is not used by the sensorfusion.
  % Sensor is disabled if disable_slipanglesensor=1
  % Sensor is enabled if disable_slipanglesensor=0

disable_9D_rear = Simulink.Parameter(0, StorageClass="ExportedGlobal", DataType="boolean")  % This parameter disables the 9D rear sensor. That means if sensor is disabled the value of the sensor is not used by the sensorfusion.
  % Sensor is disabled if disable_9D_rear=1
  % Sensor is enabled if disable_9D_rear=0

disable_9D_front = Simulink.Parameter(0, StorageClass="ExportedGlobal", DataType="boolean")  % This parameter disables the 9d front sensor. That means if sensor is disabled the value of the sensor is not used by the sensorfusion.
  % Sensor is disabled if disable_9D_front=1
  % Sensor is enabled if disable_9D_front=0

BrakeMap_default_data = Simulink.Parameter([0 0.1 0.2 0.3 0.4 0.5 0.6 0.7 0.8 0.9 1], StorageClass="ExportedGlobal", DataType="single")
BrakeMap_default_breakpoints = Simulink.Parameter([0 0.1 0.2 0.3 0.4 0.5 0.6 0.7 0.8 0.9 1], StorageClass="ExportedGlobal", DataType="single")
BrakeMapData_AlDe = Simulink.Parameter([0 0.028788 0.083333 0.14394 0.23485 0.32576 0.43182 0.56818 0.70152 0.85303 1], StorageClass="ExportedGlobal", DataType="single")
BrakeReq = Simulink.Signal(StorageClass="ExportedGlobal")
DriverDemand = Simulink.Signal(StorageClass="ExportedGlobal")
TorqueReq = Simulink.Signal(StorageClass="ExportedGlobal")
dv_sdc_steering_desired_vdc = Simulink.Signal(StorageClass="ExportedGlobal")
dv_sdc_acceleration_desired_vdc = Simulink.Signal(StorageClass="ExportedGlobal")
sdc_acc_desired_debug_14 = Simulink.Signal(StorageClass="ExportedGlobal")
sdc_acc_desired_debug_15 = Simulink.Signal(StorageClass="ExportedGlobal")
sdc_acc_desired_debug_16 = Simulink.Signal(StorageClass="ExportedGlobal")
sdc_acc_desired_debug_17 = Simulink.Signal(StorageClass="ExportedGlobal")
sdc_acc_desired_debug_18 = Simulink.Signal(StorageClass="ExportedGlobal")
sdc_acc_desired_debug_19 = Simulink.Signal(StorageClass="ExportedGlobal")
sdc_acc_desired_debug_20 = Simulink.Signal(StorageClass="ExportedGlobal")
sdc_acc_desired_debug_21 = Simulink.Signal(StorageClass="ExportedGlobal")
sdc_acc_desired_debug_22 = Simulink.Signal(StorageClass="ExportedGlobal")
sdc_acc_desired_debug_23 = Simulink.Signal(StorageClass="ExportedGlobal")
sdc_acc_desired_debug_24 = Simulink.Signal(StorageClass="ExportedGlobal")
sdc_acc_desired_debug_25 = Simulink.Signal(StorageClass="ExportedGlobal")