% Simulink data dictionary dd_PowerLimitation.sldd
% references dd_GlobalShare.sldd
% references dd_IO.sldd

LimitingFactor = Simulink.Signal(StorageClass="ExportedGlobal")
TorqueRequest_pl = Simulink.Signal(StorageClass="ExportedGlobal")
OverCurrentFactor = Simulink.Signal(StorageClass="ExportedGlobal")
Pmax_measured = Simulink.Signal(StorageClass="ExportedGlobal")
Pmax_recu_measured = Simulink.Signal(StorageClass="ExportedGlobal")
LimFactor_Kennfeld = Simulink.Signal(StorageClass="ExportedGlobal")
PowerPredicted_PL = Simulink.Signal(StorageClass="ExportedGlobal")

efficiency_coeff_pPL2 = Simulink.Parameter([31.99815 -390.9238 -122.2642 397.6914
 -0.1275453 0.08935682 -0.01901383 -0.1513472
 -0.2272347 2.078527 0.7272748 -2.096505
 -0.3846274 -0.03968753 0.03211756 0.02040363
 8.522897e-05 -8.20045e-06 -1.924539e-05 6.121186e-05
 0.001023985 -0.0006646846 0.0001122712 0.00109626
 0.001049987 -0.007387635 -0.002843057 0.007373505
 -0.0002838173 0.000179315 7.745387e-05 -5.927575e-05
 0.001187059 0.0004517204 -0.0001403503 -7.031757e-06
 0.001513296 -0.002517686 0.0003553077 -0.0002967312
 3.105969e-09 -2.951126e-08 5.241838e-08 9.207662e-08
 -5.060267e-07 2.704607e-08 1.517709e-07 -4.271259e-07
 -2.868913e-06 1.909503e-06 -2.907086e-07 -2.993428e-06
 -2.299948e-06 1.32322e-05 5.529264e-06 -1.291167e-05
 1.132881e-07 1.564074e-07 -1.966566e-07 2.472828e-08
 -1.541391e-08 -8.031502e-07 1.101438e-07 4.299746e-07
 -1.947355e-06 -1.499434e-06 2.294856e-07 -2.811141e-07
 4.569764e-06 7.249661e-07 -1.506369e-06 -1.085112e-06
 -2.074596e-06 4.713479e-06 3.365742e-07 1.78575e-06
 -9.629305e-08 5.011216e-06 -9.302194e-06 -9.252329e-06
 0.001563278 0.002530165 0.0006424187 -0.002061403], DataType="single")

power_bias_pPL = Simulink.Parameter(10000, StorageClass="ExportedGlobal", DataType="single")  % Bias auf die maximale Leistung für das Kennfeld
LimFactor_Feedback = Simulink.Signal(StorageClass="ExportedGlobal")

efficiency_coeff_pPL = Simulink.Parameter([0.004507314 -0.0286739 0.04743097 -0.0171699
 0.2701051 0.4923159 -0.423143 -0.2166093
 0.0002261816 -0.0002065763 -4.3187e-05 -0.0002184469
 0.001034931 0.003726102 -0.0006664433 0.004029471
 -0.01210754 -0.02079977 0.0171163 0.009449768
 4.856284e-07 -7.759288e-07 -4.043964e-08 -2.684297e-07
 -5.893608e-06 1.225296e-05 4.487377e-06 8.65026e-06
 3.273033e-05 -2.180515e-05 4.856027e-05 -5.291383e-05
 0.0001688479 0.0002667231 -0.0002290466 -9.178149e-05
 -4.785598e-11 -1.611211e-09 -1.126999e-09 3.02244e-10
 -1.320841e-08 7.621922e-09 -1.503462e-09 5.039087e-09
 5.757596e-08 -9.407913e-08 -2.300074e-08 -6.627499e-08
 -2.152203e-07 8.288108e-08 -2.730185e-07 3.4668e-07
 -7.068135e-07 -1.074908e-06 9.700852e-07 2.176193e-07
 0.05402662 -0.05638754 -0.08107607 0.08016968], DataType="single")  % Koeffizienten des Wirkungsgradkennfeldes (3. Ordnung WheelSpeed / TorqueRequest,
  % MotorTemp linear)

recu_power_bias_pPL = Simulink.Parameter(5000, StorageClass="ExportedGlobal", DataType="single", Unit="W")
invertertemp_derating_pl_breakpoints_pPL = Simulink.Parameter([0 67 70 72], StorageClass="ExportedGlobal", DataType="single")  % [0 65 68 70] standard
motortemp_derating_pl_breakpoints_pPL = Simulink.Parameter([0 130 133 135], StorageClass="ExportedGlobal", DataType="single")  % [0 120 130 135] standard derating
recu_bias_overshoot_pPL = Simulink.Parameter(1000, StorageClass="ExportedGlobal", DataType="single")
power_time_overshoot_pPL = Simulink.Parameter(0.5, StorageClass="ExportedGlobal", DataType="single", Min=0.1)
recu_time_overshoot_pPL = Simulink.Parameter(0.5, StorageClass="ExportedGlobal", DataType="single", Min=0.1)
power_bias_overshoot_pPL = Simulink.Parameter(1000, StorageClass="ExportedGlobal", DataType="single")
switch_on_point_feedback_pPL = Simulink.Parameter(12500, StorageClass="ExportedGlobal", DataType="single")
enable_power_feedback_pPL = Simulink.Parameter(1, StorageClass="ExportedGlobal", DataType="boolean")
switch_powerlimit_kennfeld_pPL = Simulink.Parameter(0, StorageClass="ExportedGlobal", DataType="boolean")
enable_lin_feedback_pPL = Simulink.Parameter(0, StorageClass="ExportedGlobal", DataType="boolean")
power_offset_pPL = Simulink.Parameter(15, StorageClass="ExportedGlobal", DataType="single")
enable_scrutimode_pPL = Simulink.Parameter(0, StorageClass="ExportedGlobal", DataType="boolean")
max_voltage_feedback_limit_pmaxrecu_pPL = Simulink.Parameter(4160, DataType="single", Unit="mV")  % Zellspannung, bei der das Derating beginnt
max_voltage_limit_pmaxrecu_pPL = Simulink.Parameter(4210, DataType="single", Unit="mV")  % Maximale erlaubte Zellspannung
lin_gain_pPL = Simulink.Parameter(0.0001, StorageClass="ExportedGlobal", DataType="single")
integrator_gain_pPL = Simulink.Parameter(0.0004, StorageClass="ExportedGlobal", DataType="single")  % Gain des I-Reglers in der Leistungsbegrenzung
integrator_gain_reculimit_pPL = Simulink.Parameter(0.05, StorageClass="ExportedGlobal", DataType="single")  % Gain des I-Reglers für das Gain-Derating
disable_powerlimit_pPL = Simulink.Parameter(0, StorageClass="ExportedGlobal")
InverterTemp_pl = Simulink.Signal(StorageClass="ExportedGlobal")
MaxCellVoltage = Simulink.Signal(StorageClass="ExportedGlobal")
TempDeratingFactor = Simulink.Signal(StorageClass="ExportedGlobal")
CellVoltageDeratingFactor = Simulink.Signal(StorageClass="ExportedGlobal")
RevolutionDeratingFactor = Simulink.Signal(StorageClass="ExportedGlobal")
switch_pmax_over_XCP_pPL = Simulink.Parameter(1, StorageClass="ExportedGlobal", DataType="boolean")  % DV: changed to 1 because settings not used (?)