% Simulink data dictionary dd_Safety.sldd
% references dd_GlobalShare.sldd
% references dd_IO.sldd
% references dd_Vehicle_E10.sldd

speedDetermByWheel = Simulink.Signal(StorageClass="ExportedGlobal", DataType="single", Dimensions=[4 1])
speedDetermBySensorfusion = Simulink.Signal(StorageClass="ExportedGlobal", DataType="single")
overMaxCellVoltage = Simulink.Signal(StorageClass="ExportedGlobal", DataType="boolean")
TorqueRequest_sa = Simulink.Signal(StorageClass="ExportedGlobal")
TorqueRequest_sa1 = Simulink.Signal(StorageClass="ExportedGlobal")
TorqueRequest_sa2 = Simulink.Signal(StorageClass="ExportedGlobal")
TorqueRequest_sa3 = Simulink.Signal(StorageClass="ExportedGlobal")
TorqueRequest_sa4 = Simulink.Signal(StorageClass="ExportedGlobal")
TorqueRequest_sa5 = Simulink.Signal(StorageClass="ExportedGlobal")
TorqueRequest_sa6 = Simulink.Signal(StorageClass="ExportedGlobal")
TorqueRequest_sa7 = Simulink.Signal(StorageClass="ExportedGlobal")
TorqueRequest_sa8 = Simulink.Signal(StorageClass="ExportedGlobal")
Pedal_TorqueValid = Simulink.Signal(StorageClass="ExportedGlobal")
BrakeMech = Simulink.Signal(StorageClass="ExportedGlobal")
Enable_TWB = Simulink.Signal(StorageClass="ExportedGlobal")

switch_Safety_pGl = Simulink.Parameter(1, StorageClass="ExportedGlobal", DataType="boolean")  % for recuperation switch-off
  % 1:switch off at 5 km/h, switch on 7 km/h (E9)
  % 0: linear interpolation between 5 and 7 km/h (KaMe)

switch_Safety_singleWheels_pGl = Simulink.Parameter(1, StorageClass="ExportedGlobal", DataType="boolean")  % switch off recuperation for single Wheels
  % 1:switch off 3 km/h, switch on 5 km/h (E9)
  % 0: linear interpolation between 3 and 5 km/h (KaMe)

lowVelocitylimit_recu_pGl = Simulink.Parameter(1.388889, StorageClass="ExportedGlobal", DataType="single", Unit="m/s")  % (5 km/h)/3.6, untere Geschwindigkeitsgrenze,
  % bei der Recuperation ausgeschaltet wird

highVelocitylimit_recu_pGl = Simulink.Parameter(1.944444, StorageClass="ExportedGlobal", DataType="single", Unit="m/s")  % (7 km/h)/3.6 obere Geschwindigkeitsgrenze, bei der Recuperation angeschaltet wird
  % wenn switch_Safety_pGl bei 0, dann wird zwischen den Grenzen linearisiert interpoliert

lowVelLimit_recu_singleWheel_pGl = Simulink.Parameter(0.8333333, StorageClass="ExportedGlobal", DataType="single", Unit="m/s")  % (3 km/h)/3.6 untere Grenze bei der die Recuperation für einzelene Räder ausgeschaltet wird
  % bzw. linearisiert wird

MaxCellVoltageLimit = Simulink.Parameter(4230, StorageClass="ExportedGlobal", DataType="single", Unit="mV")  % Max voltage of one cell. Used for hard shutdown. unit has to be changed to Volt
  % Achtung: noch Stand E8, abklären mit HV-Leitung

highVelLimit_recu_singleWheel_pGl = Simulink.Parameter(2.2222222, StorageClass="ExportedGlobal", DataType="single", Unit="m/s")  % 2.2222 = (8km/h)/3.6 obere Grenze, bei der die Recuperation für einzelne Räder angeschaltet wird.
  % bzw. bei switch_Safety_singleWheel_pGl=0 linearisiert wird.
  % 1.388888888888889 = (5km/h)/3.6

torque_safety_debug_1 = Simulink.Signal(StorageClass="ExportedGlobal")  % Check if torque is requested after no recu below 5mkh check
torque_safety_debug_2 = Simulink.Signal(StorageClass="ExportedGlobal")  % Check if torque is requested after no recu if cell V too high check
torque_safety_debug_3 = Simulink.Signal(StorageClass="ExportedGlobal")  % torque after norecu when speed below 3kmh check
torque_safety_debug_4 = Simulink.Signal(StorageClass="ExportedGlobal")  % torque request after only request moments if motors are active check

dv_disable_torque_safety = Simulink.Parameter(0, StorageClass="ExportedGlobal")  % 0 -> Torque safety blocks are enabled
  % 1 -> Torque safety blocks are disabled (ATTENTION)

TorqueRequest_sa_ev = Simulink.Signal(StorageClass="ExportedGlobal")
TorqueRequest_sa_dv = Simulink.Signal(StorageClass="ExportedGlobal")
disable_torque_valid_flag = Simulink.Parameter(0, StorageClass="ExportedGlobal")