% Simulink data dictionary dd_SensorFusion.sldd
% references dd_Environment.sldd
% references dd_GlobalShare.sldd
% references dd_IO.sldd
% references dd_Vehicle_E10.sldd

debug_measurementsAtCOG = Simulink.Bus()
  AccXFront: single
  AccYFront: single
  AccXRear: single
  AccYRear: single
  YawRateFront: single
  YawRateRear: single
  VelX: single
  VelY: single
  YawAngleFront: single
  YawAngleRear: single
  YawAcceleration: single

select_sensor_fusion_pSF = Simulink.Parameter(1, StorageClass="ExportedGlobal", DataType="uint8", Min=1, Max=3)  % Select SensorFusion, which is used to estimate VehicleState and TireLoads
  % 1 .. adjusted SensorFusion of E8
  % 2 .. new SensorFusion of AdSc
  % 3 .. SensorFusion E8

AccX_front_in = Simulink.Signal(StorageClass="ExportedGlobal")
AccY_front_in = Simulink.Signal(StorageClass="ExportedGlobal")
AccZ_front_in = Simulink.Signal(StorageClass="ExportedGlobal")
RollRate_front_in = Simulink.Signal(StorageClass="ExportedGlobal")
PitchRate_front_in = Simulink.Signal(StorageClass="ExportedGlobal")
YawRate_front_in = Simulink.Signal(StorageClass="ExportedGlobal")
AccX_front_Sq_in = Simulink.Signal(StorageClass="ExportedGlobal")
AccY_front_Sq_in = Simulink.Signal(StorageClass="ExportedGlobal")
AccZ_front_Sq_in = Simulink.Signal(StorageClass="ExportedGlobal")
RollRate_front_Sq_in = Simulink.Signal(StorageClass="ExportedGlobal")
PitchRate_front_Sq_in = Simulink.Signal(StorageClass="ExportedGlobal")
YawRate_front_Sq_in = Simulink.Signal(StorageClass="ExportedGlobal")
AccX_rear_in = Simulink.Signal(StorageClass="ExportedGlobal")
AccY_rear_in = Simulink.Signal(StorageClass="ExportedGlobal")
AccZ_rear_in = Simulink.Signal(StorageClass="ExportedGlobal")
RollRate_rear_in = Simulink.Signal(StorageClass="ExportedGlobal")
PitchRate_rear_in = Simulink.Signal(StorageClass="ExportedGlobal")
YawRate_rear_in = Simulink.Signal(StorageClass="ExportedGlobal")
AccX_rear_Sq_in = Simulink.Signal(StorageClass="ExportedGlobal")
AccY_rear_Sq_in = Simulink.Signal(StorageClass="ExportedGlobal")
AccZ_rear_Sq_in = Simulink.Signal(StorageClass="ExportedGlobal")
RollRate_rear_Sq_in = Simulink.Signal(StorageClass="ExportedGlobal")
PitchRate_rear_Sq_in = Simulink.Signal(StorageClass="ExportedGlobal")
YawRate_rear_Sq_in = Simulink.Signal(StorageClass="ExportedGlobal")
VelX_in = Simulink.Signal(StorageClass="ExportedGlobal")
VelY_in = Simulink.Signal(StorageClass="ExportedGlobal")
VelX_Sq_in = Simulink.Signal(StorageClass="ExportedGlobal")
VelY_Sq_in = Simulink.Signal(StorageClass="ExportedGlobal")
valueIsNew_in = Simulink.Signal(StorageClass="ExportedGlobal")
WheelSpeed_in = Simulink.Signal(StorageClass="ExportedGlobal")
RockerAngle_FL_in = Simulink.Signal(StorageClass="ExportedGlobal")
RockerAngle_FR_in = Simulink.Signal(StorageClass="ExportedGlobal")
RockerAngle_RL_in = Simulink.Signal(StorageClass="ExportedGlobal")
RockerAngle_RR_in = Simulink.Signal(StorageClass="ExportedGlobal")
RockerAngle_FL_Sq_in = Simulink.Signal(StorageClass="ExportedGlobal")
RockerAngle_FR_Sq_in = Simulink.Signal(StorageClass="ExportedGlobal")
RockerAngle_RL_Sq_in = Simulink.Signal(StorageClass="ExportedGlobal")
RockerAngle_RR_Sq_in = Simulink.Signal(StorageClass="ExportedGlobal")
TireLoadE10 = Simulink.Signal(StorageClass="ExportedGlobal")
TireLoadE8 = Simulink.Signal(StorageClass="ExportedGlobal")

Camber_posZ_front = Simulink.LookupTable(
  Table=Simulink.lookuptable.Table(
    Value=[-25 -22.5 -20 -17.5 -15 -12.5 -10 -7.5 -5 -2.5 0 2.5 5 7.5 10 12.5 15 17.5 20 22.5 25],
    Dimensions=[1 21],
    FieldName="Table"),
  BreakpointsSpecification="Explicit values",
  Breakpoints=Simulink.lookuptable.Breakpoint(
    Value=[-0.83 -0.74 -0.65 -0.56 -0.47 -0.39 -0.3 -0.23 -0.15 -0.07 0 0.07 0.14 0.2 0.22 0.27 0.32 0.37 0.41 0.46 0.5],
    TunableSizeName="N1",
    Dimensions=[1 21],
    FieldName="BP1"))

breakpoints_camber_posZ = Simulink.Parameter([-25 -22.5 -20 -17.5 -15 -12.5 -10 -7.5 -5 -2.5 0 2.5 5 7.5 10 12.5 15 17.5 20 22.5 25])
camber_posZ_rear = Simulink.Parameter([-0.64 -0.57 -0.5 -0.44 -0.37 -0.3 -0.24 -0.18 -0.12 -0.06 0 0.06 0.11 0.17 0.22 0.27 0.32 0.37 0.41 0.46 0.5])
camber_posZ_front = Simulink.Parameter([-0.83 -0.74 -0.65 -0.56 -0.47 -0.39 -0.3 -0.23 -0.15 -0.07 0 0.07 0.14 0.2 0.27 0.33 0.39 0.44 0.5 0.55 0.6])
breakpoints_camber_RollAngle = Simulink.Parameter([-25 -22.5 -20 -17.5 -15 -12.5 -10 -7.5 -5 -2.5 0 2.5 5 7.5 10 12.5 15 17.5 20 22.5 25])
camber_RollAngle_rear = Simulink.Parameter([-0.64 -0.57 -0.5 -0.44 -0.37 -0.3 -0.24 -0.18 -0.12 -0.06 0 0.06 0.11 0.17 0.22 0.27 0.32 0.37 0.41 0.46 0.5])
camber_RollAngle_front = Simulink.Parameter([-0.83 -0.74 -0.65 -0.56 -0.47 -0.39 -0.3 -0.23 -0.15 -0.07 0 0.07 0.14 0.2 0.27 0.33 0.39 0.44 0.5 0.55 0.6])

switch_VelYcalculation_pSF = Simulink.Parameter(0, StorageClass="ExportedGlobal", DataType="single")  % 0: kalman filter, Umrechnung von Messung direkt
  % 1: classic kalman filter, Umrechnung auf SP mit H-Matrix
  % 2: ohne Kalman filter

testVelY_pSF = Simulink.Parameter(1, StorageClass="ExportedGlobal", DataType="single", Min=0, Max=1)  % 1: VelY Sq normal, wie von v2o
  % 0: VelY SQ wird auf 22 gesetzt, Ersatzrechnung für VelY

testStart_VelX_pSF = Simulink.Parameter(0, StorageClass="ExportedGlobal", DataType="boolean")  % 0: normal kalman, lineare Interpolation zwischen 1.3 und 2.5 m/sec
  % 1: bei avgWheelVelocities unter 1.5 Schwimmwinkel direkt

VehicleState = Simulink.Signal(StorageClass="ExportedGlobal")
TireSlipLong = Simulink.Signal(StorageClass="ExportedGlobal")

R_VelX_pSF = Simulink.Parameter(0.001, StorageClass="ExportedGlobal", DataType="single", Min=1.0e-5, Max=0.1)  % Glättungsparameter für VelX aus KalmanFilter.
  % Je höher, desto geglätteter (und verzögerter wird der Wert)
  % Je geringer, desto mehr vertraut er dem Wert aus dem Schwimmwinkel.
  % Testen 0.00001

dv_ecu_dv_vd_request_state_request_stateflow_in = Simulink.Signal(StorageClass="ExportedGlobal")
mag_calib_front_center = Simulink.Parameter(single([-0.0624323301; -0.0364960097; -0.434179813]))
mag_calib_front_compmatrix = Simulink.Parameter(single([0.0651183128 0.00385301397 -0.0311028101; 0.003853017 0.0492105186 0.0143292304; -0.0311028101 0.0143292304 0.998753071]))
mag_calib_rear_center = Simulink.Parameter(single([-0.0154638952; -0.01811653; -0.0271186531]))
mag_calib_rear_compmatrix = Simulink.Parameter(single([0.418115586 -0.101980098 0.264017612; -0.101980098 0.373364806 -0.228562504; 0.264017612 -0.228562504 0.756130576]))
enable_kalman_standing = Simulink.Parameter(0, StorageClass="ExportedGlobal")  % Set to 1 if the kalman filter should work while the car is standing (default 0)
ms_9d_front_accx_debug = Simulink.Signal(StorageClass="ExportedGlobal")
ms_9d_front_rollrate_debug = Simulink.Signal(StorageClass="ExportedGlobal")
bias_measurements_debug = Simulink.Signal(StorageClass="ExportedGlobal")
used_measurements_debug = Simulink.Signal(StorageClass="ExportedGlobal")

control_used_measurements = Simulink.Bus()
  PosX_measurement: single
  VelX_measurement: single
  AccX_measurement: single
  PosY_measurement: single
  VelY_measurement: single
  AccY_measurement: single
  PosZ_measurement: single
  VelZ_measurement: single
  AccZ_measurement: single
  RollAngle_measurement: single
  RollRate_measurement: single
  RollAcc_measurement: single
  PitchAngle_measurement: single
  PitchRate_measurement: single
  PitchAcc_measurement: single
  YawAngle_measurement: single
  YawRate_measurement: single
  YawAcc_measurement: single
  wheelVel_FL_measurement: single
  wheelVel_FR_measurement: single
  wheelVel_RL_measurement: single
  wheelVel_RR_measurement: single
  RockerAngle_FL_measurement: single
  RockerAngle_FR_measurement: single
  RockerAngle_RL_measurement: single
  RockerAngle_RR_measurement: single

bias_running_SiDe = Simulink.Signal(StorageClass="ExportedGlobal")
kalman_running_SiDe = Simulink.Signal(StorageClass="ExportedGlobal")

control_bias_kalman = Simulink.Bus()
  v2o_VelX_bias: single
  v2o_VelY_bias: single
  v2o_slipangle_bias: single
  x9D_Front_AccX_bias: single
  x9D_Front_AccY_bias: single
  x9D_Front_AccZ_bias: single
  x9D_Front_RollRate_bias: single
  x9D_Front_PitchRate_bias: single
  x9D_Front_YawRate_bias: single
  x9D_Rear_AccX_bias: single
  x9D_Rear_AccY_bias: single
  x9D_Rear_AccZ_bias: single
  x9D_Rear_RollRate_bias: single
  x9D_Rear_PitchRate_bias: single
  x9D_Rear_YawRate_bias: single
  wheelspeed_FL_bias: single
  wheelspeed_FR_bias: single
  wheelspeed_RL_bias: single
  wheelspeed_RR_bias: single
  RockerAngle_FL_bias: single
  RockerAngle_FR_bias: single
  RockerAngle_RL_bias: single
  RockerAngle_RR_bias: single

bias_used_kalman_SiDe = Simulink.Signal(StorageClass="ExportedGlobal")
measurements_used_kalman_SiDe = Simulink.Signal(StorageClass="ExportedGlobal")

control_used_measurements_SiDe = Simulink.Bus()
  VelX_measurement: single
  VelY_measurement: single
  YawAngle_9DFront_measurement: single
  YawRate_9DFront_measurement: single
  YawAngle_9DRear_measurement: single
  YawRate_9DRear_measurement: single
  wheelvelocity_FL_measurement: single
  wheelvelocity_FR_measurement: single
  wheelvelocity_RL_measurement: single
  wheelvelocity_RR_measurement: single

control_bias_kalman_SiDe = Simulink.Bus()
  VelX_bias: single
  VelY_bias: single
  YawAngle_9DFront_bias: single
  YawRate_9DFront_bias: single
  YawAngle_9DRear_bias: single
  YawRate_9DRear_bias: single
  wheelvelocity_FL_bias: single
  wheelvelocity_FR_bias: single
  wheelvelocity_RL_bias: single
  wheelvelocity_RR_bias: single

enable_v2o_direct = Simulink.Parameter(0, StorageClass="ExportedGlobal")
enable_SensorFusion_SiDe = Simulink.Parameter(0, StorageClass="ExportedGlobal")

control_GPS = Simulink.Bus()
  GPS_Longitude: single
  GPS_Latitude: single

control_VehicleStateCov = Simulink.Bus()
  VelX_Cov: single
  VelY_Cov: single
  YawAngle_Cov: single
  YawRate_Cov: single