% Simulink data dictionary dd_TractionControl.sldd
% references dd_GlobalShare.sldd
% references dd_IO.sldd
% references dd_Vehicle_E10.sldd

LQR_dFz = single(reshape([0.163148656 0.163148656 0.163148656 0.163148656 0.163148656 0.163148656 0.163148656 0.163148656 0.163148656 0.163148656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], 27, 43, 8))
LQR_Konst = single(reshape([16.3148651 16.3148651 16.3148651 16.3148651 16.3148651 16.3148651 16.3148651 16.3148651 16.3148651 16.3148651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], 27, 43, 8))
LQR_LU = single(reshape([1022.42694 1011.15198 1007.42102 1005.56061 1004.44604 1003.70367 1003.17371 1002.77649 1002.46759 1002.22058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], 27, 43, 8))
TorqueRequest_test = Simulink.Signal(StorageClass="ExportedGlobal")
kappa = Simulink.Signal(StorageClass="ExportedGlobal")
TorqueLimit_tc_ub = Simulink.Signal(StorageClass="ExportedGlobal")
TorqueRequest_tc = Simulink.Signal(StorageClass="ExportedGlobal")
TorqueLimit_tc_lb = Simulink.Signal(StorageClass="ExportedGlobal")
Slip_dynamic_mode_pTC = Simulink.Parameter(0.25, StorageClass="ExportedGlobal", DataType="single")
eta_pTC = Simulink.Parameter(120, StorageClass="ExportedGlobal", DataType="single")
beta_pTC = Simulink.Parameter(2, StorageClass="ExportedGlobal", DataType="single")
SlidingSurface = Simulink.Signal(StorageClass="ExportedGlobal", DataType="single")

enable_new_TC_pTC = Simulink.Parameter(0, StorageClass="ExportedGlobal", DataType="boolean")  % 0 .. E8 TC activated: lambda_mux, kp, lyap_filtercoeff to be tuned
  % 1 .. Hieus TC activated: eta, beta to be parametrized additionally

constantslip_brake_XCP_pTC = Simulink.Parameter(0.11, StorageClass="ExportedGlobal", DataType="single")  % define seperate parameter for braking slip
Adaptive_damping_pTC = Simulink.Parameter(-1, StorageClass="ExportedGlobal", DataType="single")
Adaptive_gamma_pTC = Simulink.Parameter([50 0 0 0; 0 50 0 0; 0 0 50 0; 0 0 0 50], StorageClass="ExportedGlobal", DataType="single")
Adaptive_RefModel_l_pTC = Simulink.Parameter(250, StorageClass="ExportedGlobal", DataType="single")
Adaptive_RefModel_T_pTC = Simulink.Parameter(0.05, StorageClass="ExportedGlobal", DataType="single")
Adaptive_SigNorm_pTC = Simulink.Parameter(0.0001, StorageClass="ExportedGlobal", DataType="single")
kappa_soll_accel_pTC = Simulink.Parameter(0.25, DataType="single")
kappa_soll_f_pTC = Simulink.Parameter(0.1, DataType="single")
kappa_soll_fbrake_pTC = Simulink.Parameter(-0.1, DataType="single")
kappa_soll_r_pTC = Simulink.Parameter(0.1, DataType="single")
kappa_soll_rbrake_pTC = Simulink.Parameter(-0.1, DataType="single")
lambda_mux_pTC = Simulink.Parameter(1.6, StorageClass="ExportedGlobal", DataType="single")
LQR_TCint_pTC = Simulink.Parameter(300, DataType="single")
Lyap_kp_pTC = Simulink.Parameter(75, DataType="single")
Lyap_LowPass_pTC = Simulink.Parameter(0.05, DataType="single")
Lyap_p_pTC = Simulink.Parameter(1, DataType="single")
Lyap_TCint_pTC = Simulink.Parameter(1000, DataType="single")
LyapDiscFilter_pTC = Simulink.Parameter(-0.9, DataType="single")
LyapTransfFuncDen_pTC = Simulink.Parameter([1 -0.9801987], DataType="single")
LyapTransfFuncNum_pTC = Simulink.Parameter(0.1980133, DataType="single")
steeringAngle_switch_pTC = Simulink.Parameter(180, StorageClass="ExportedGlobal", DataType="single")
theta_pTC = Simulink.Parameter(0.4, DataType="single")
velLimitInput_XCP_pTC = Simulink.Parameter(0.1, StorageClass="ExportedGlobal", DataType="single")
Lyap_kp_XCP_pTC = Simulink.Parameter(75, StorageClass="ExportedGlobal", DataType="single")  % standard value of E8 is 75
Lyap_kp_switch_over_XCP_pTC = Simulink.Parameter(0, StorageClass="ExportedGlobal", DataType="single")
lyapFilterCoeff_XCP_pTC = Simulink.Parameter(-0.9, StorageClass="ExportedGlobal", DataType="single")  % standard value of E8 is -0.9
lambda_mux_XCP_pTC = Simulink.Parameter(1.65, StorageClass="ExportedGlobal", DataType="single")  % standard value of E8 is 1.6
activate_TC_forMinimal_pTC = Simulink.Parameter(0, StorageClass="ExportedGlobal", DataType="single")
velLimitInput_switch_over_XCP_pTC = Simulink.Parameter(0, StorageClass="ExportedGlobal", DataType="single")
lyapFilterCoeff_switch_over_XCP_pTC = Simulink.Parameter(0, StorageClass="ExportedGlobal", DataType="single")
lambda_mux_switch_over_XCP_pTC = Simulink.Parameter(0, StorageClass="ExportedGlobal", DataType="single")

constantslip_XCP_pTC = Simulink.Parameter(0.15, StorageClass="ExportedGlobal", DataType="single")  % Reifenschlupf, der zugelassen werden soll.
  % 0 .. kein Schlupf
  % 0.13 .. Standard-Parameter von E8

slip_switch_over_XCP_pTC = Simulink.Parameter(0, StorageClass="ExportedGlobal", DataType="single")  % Switch XCP and Telemetrie-Settingsbus
  % 0 .. Settingsbus
  % 1 .. XCP

switch_TCversions_pGL = Simulink.Parameter(1, StorageClass="ExportedGlobal", DataType="single")  % 1 - > E9
  % 2 -> HiTr (E9)
  % 3 -> SMC (ArSu)
  % 4 -> STSMC (ArSu)
  % 5-> E9 mit Slip aus SF

kappa_soll = Simulink.Signal(StorageClass="ExportedGlobal")
T_real = Simulink.Signal(StorageClass="ExportedGlobal")
omega_XCP = Simulink.Signal(StorageClass="ExportedGlobal")
Fz_XCP = Simulink.Signal(StorageClass="ExportedGlobal")
dotv_TC = Simulink.Signal(StorageClass="ExportedGlobal")
v_TC = Simulink.Signal(StorageClass="ExportedGlobal")
TireSlipLong_TC = Simulink.Signal(StorageClass="ExportedGlobal")

TC_switch_over_XCP_pTC = Simulink.Parameter(1, StorageClass="ExportedGlobal", DataType="single")  % enable switching TC on and off through XCP
  % DV: changed to 1

tractioncontrol_mode_XCP_pTC = Simulink.Parameter(0, StorageClass="ExportedGlobal", DataType="single")  % 1 .. TC enabled
  % 0 .. TC is switched off
  % DV: changed to 0