% Simulink data dictionary dd_VehicleModels.sldd

atm_Fz0 = Simulink.Parameter(1100, DataType="single")
p_Dx3 = Simulink.Parameter(13, DataType="single")
s_R = Simulink.Parameter(1.2, Unit="m")  % Spurweite hinten [m]
s_F = Simulink.Parameter(1.2, Unit="m")  % Spurweite vorne [m]

AxleFrontX = Simulink.Parameter(0.7836, Min=0.7836, Max=0.7836, Unit="m")  % Distance between front axle and CG in x direction
  % E9

AxleRearX = Simulink.Parameter(-0.7564, Min=-0.7564, Max=-0.7564, Unit="m")  % Distance between rear axle and CG in x direction E9
YawRadius = Simulink.Parameter(0.6164)  % ist hier Trägheitsradius um die z-Achse gemeint?? Stand von E8?