% Simulink data dictionary dd_Vehicle_E10.sldd

gearbox_efficiency = Simulink.Parameter(0.96, DataType="single", Unit="1")  % geschätzter Getriebewirkungsgrad vom E9 Getriebe

h_aero = Simulink.Parameter(0.268, DataType="single", Unit="m")  % Höhe Angriffsfläche Luftwiderstandskraft [m]
  % Achtung: Veralteter Wert! E7, E8?

h_cg = Simulink.Parameter(0.2527, DataType="single", Unit="m")  % Höhe des Schwerpunktes E9 [m]

tire_cornering_stiffness = Simulink.Parameter(-40000, DataType="single", Unit="N/rad")  % Quelle der Daten hier angeben!!
  % TTC?
  % Achtung: E8-Stand
  % Pro Reifen, pro Achse?

vehicle_mass = Simulink.Parameter(240, DataType="single", Unit="kg")  % Gesamtfahrzeugmasse E9
wheelbase = Simulink.Parameter(1.54, DataType="single", Unit="m")  % Radstand E9
BxTM = Simulink.Parameter(9, DataType="single")
ByTM = Simulink.Parameter(-20, DataType="single")
CxTM = Simulink.Parameter(2, DataType="single")
CyTM = Simulink.Parameter(1.507, DataType="single")
EyTM = Simulink.Parameter(0.502, DataType="single")
J_Syy = Simulink.Parameter(48.27, DataType="single", Unit="kg*m^2")  % Hauptträgheitsmoment der gefederten Masse um y-Achse [kg*m^2]
J_Sxx = Simulink.Parameter(13.27, DataType="single", Unit="kg*m^2")  % Hauptträgheitsmoment der gefederten Masse um x-Achse [kg*m^2]
vehicle_inertia_yaw = Simulink.Parameter(50, DataType="single", Unit="kg*m^2")  % Hauptträgheitsmoment des Gesamtfahrzeugs um z-Achse E9 [kg*m^2] (gefederte Masse und ungefederte Masse)
p_Dx1 = Simulink.Parameter(1, DataType="single")  % Wert für Pacejka Modell (wird in Traktionskontrolle u.a. verwendet)
p_Dx2 = Simulink.Parameter(-0.53, DataType="single")  % Wert für Pacejka Modell (wird in Traktionskontrolle u.a. verwendet)

wheel_inertia = Simulink.Parameter(0.3, DataType="single", Unit="kg*m^2")  % Trägheitsmoment des Rades. (Stand E8, keine Ahnung ob Getriebe mit drin)
  % es ist ein neuer Wert verfügbar --> Hier sollte glauben wir die ganze Radeinheit, auf die Raddrehzahl bezogen, beschrieben werden.
  % Rechnung von NiHo beachten für E9

x9DRearY = Simulink.Parameter(0, DataType="single", Unit="m")  % coordinates of rear 9D sensor in SAE y direction

cdA = Simulink.Parameter(1.68, StorageClass="ExportedGlobal", DataType="single", Unit="1")  % c_w-Wert entspricht folglich nicht dem wirklichen cw-Wert, weil A_crosssection auf eins normiert wird.
  % Entspricht A*c_w.

l_R = Simulink.Parameter(0.7459, DataType="single", Unit="m")  % Abstand Schwerpunkt zu Hinterachse E9 in x-Richtung [m]
  % bis FSS 0.7564

l_F = Simulink.Parameter(0.7941, DataType="single", Unit="m")  % Abstand Schwerpunkt zu Vorderachse E9 in x-Richtung [m]
track_angle_front = Simulink.Parameter(0.2, DataType="single", Unit="deg")
wheel_kinematics_breakpoints = Simulink.Parameter([-110; -99; -88; -77; -66; -55; -44; -33; -22; -11; 0; 11; 22; 33; 44; 55; 66; 77; 88; 99; 110], DataType="single", Unit="deg")
switch_rocker_direction_FL = Simulink.Parameter(1, StorageClass="ExportedGlobal", DataType="single")  % switch to -1, if TireLoad output should be implausible
switch_rocker_direction_RR = Simulink.Parameter(1, StorageClass="ExportedGlobal", DataType="single")
switch_rocker_direction_RL = Simulink.Parameter(1, StorageClass="ExportedGlobal", DataType="single")
switch_rocker_direction_FR = Simulink.Parameter(1, StorageClass="ExportedGlobal", DataType="single")

damp_coef_roll_rear_pull = Simulink.Parameter([0.04 4000 400], StorageClass="ExportedGlobal", DataType="single", Unit="N/(m/s)")  % damping coefficient of the rear roll damper while PULLING.
  % Unit: kg/s bzw. N/(m/s)
  % [velocity at crinkle[in m/s], gradient at low speed[in N/(m/s^2)] , gradient at higher speed[in N/(m/s^2)]]

damp_coef_roll_rear_push = Simulink.Parameter([0.03 6000 600], StorageClass="ExportedGlobal", DataType="single", Unit="N/(m/s)")  % damping coefficient of the rear roll damper while PUSHING.
  % Unit: kg/s bzw. N/(m/s)
  % [velocity at crinkle[in m/s], gradient at low speed[in N/(m/s^2)] , gradient at higher speed[in N/(m/s^2)]]

switch_lat_accel_tireloadestimE8 = Simulink.Parameter(-1, StorageClass="ExportedGlobal", DataType="single")
spring_stiff_roll_rear = Simulink.Parameter(40000, StorageClass="ExportedGlobal", DataType="single", Unit="N/m")  % spring stiffness of rear roll damper. Unit: N/m
spring_stiff_roll_front = Simulink.Parameter(40000, StorageClass="ExportedGlobal", DataType="single", Unit="N/m")  % spring stiffness of front roll damper. Unit: N/m
Fz0 = Simulink.Parameter(603.2775, DataType="single")
motor_torque_data = Simulink.Parameter([-27.7 -26.7 -25.5 -24.1 -22.4 -20.5 -18.5 -16.2 -13.8 -11.2 -10.1 -9 -7.8 -6.7 -5.5 -4.4 -3.3 -2.1 -0.9 0 0.9 2.1 3.3 4.4 5.5 6.7 7.8 9 10.1 11.2 13.8 16.2 18.5 20.5 22.4 24.1 25.5 26.7 27.7], DataType="single")
motor_torque_breakpoints = Simulink.Parameter([-98.317001 -91.605003 -83.987999 -76.350998 -68.718002 -61.085999 -53.451 -45.814999 -38.173 -30.547001 -27.493999 -24.450001 -21.4 -18.35 -15.3 -12.26 -9.2110004 -6.1700001 -3.142 0 3.142 6.1700001 9.2110004 12.26 15.3 18.35 21.4 24.450001 27.493999 30.547001 38.173 45.814999 53.451 61.085999 68.718002 76.350998 83.987999 91.605003 98.317001], DataType="single")
clA_front = Simulink.Parameter(-2.5, DataType="single")  % Abtriebsbeiwert Vorderachse, Achtung es ist nur ein DummyWert hinterlegt

clA_rear = Simulink.Parameter(-2.5, DataType="single")  % Abtriebsbeiwert Hinterachse
  % Achtung es ist nur ein DummyWert hinterlegt

wheel_kinematics_FL_data = Simulink.Parameter([-31.406; -27.9; -24.526; -21.258; -18.075; -14.961; -11.902; -8.886; -5.903; -2.944; 0; 2.937; 5.874; 8.819; 11.78; 14.765; 17.781; 20.838; 23.945; 27.115; 30.358], StorageClass="ExportedGlobal", DataType="single", Unit="deg")
wheel_kinematics_FR_data = Simulink.Parameter([-30.358; -27.115; -23.945; -20.838; -17.781; -14.765; -11.78; -8.819; -5.874; -2.937; 0; 2.944; 5.903; 8.886; 11.902; 14.961; 18.075; 21.258; 24.526; 27.9; 31.406], StorageClass="ExportedGlobal", DataType="single", Unit="deg")
gamma_stat_front = Simulink.Parameter(1.2, StorageClass="ExportedGlobal", DataType="single")  % statischer Sturz von Nisa, Grad in Degree
gamma_stat_rear = Simulink.Parameter(1, StorageClass="ExportedGlobal", DataType="single")  % Grad in Degree, achtung E10 Wert!
track_width_front = Simulink.Parameter(1.2, DataType="single", Unit="m")  % vordere Spurbreite E9
track_width_rear = Simulink.Parameter(1.2, DataType="single", Unit="m")  % hintere Spurbreite E9

motion_ratio_front = Simulink.Parameter(0.000992, DataType="single")  % MotionRatio rocker front. Unit: m/°
  % This is the transmission ratio between the rocker angle
  % and the wheel z-travel at the front.

motion_ratio_rear = Simulink.Parameter(0.0009311, DataType="single")  % MotionRatio rocker rear. Unit: m/°
  % This is the transmission ratio between the rocker angle
  % and the wheel z-travel at the rear.

m_sprung = Simulink.Parameter(197, DataType="single", Unit="kg")  % Fahrzeugaufbaumasse (mit Fahrer) E9 [kg], siehe Gewichtsliste https://docs.google.com/spreadsheets/d/1k2Ppfq6BRhNMlSx6exIIbvPMnhkeEFfXzTBAsjfKGcU/edit?usp=sharing
m_unsprung_quarter = Simulink.Parameter(10, DataType="single", Unit="kg")  % ein Viertel der gesamten ungefederten Masse E9 [kg], siehe Gewichtsliste https://docs.google.com/spreadsheets/d/1k2Ppfq6BRhNMlSx6exIIbvPMnhkeEFfXzTBAsjfKGcU/edit?usp=sharing
x9DRearX = Simulink.Parameter(-0.6, DataType="single", Unit="m")  % coordinates of rear 9D sensor in SAE x direction

steer_kinematics_SWA_data = Simulink.Parameter([-107.1129; -97.63102; -88.30798; -78.94953; -69.36236; -59.36109; -48.78262; -37.51342; -25.53012; -12.94119; 0; 12.94119; 25.53012; 37.51342; 48.78262; 59.36109; 69.36236; 78.94953; 88.30798; 97.63102; 107.1129], StorageClass="ExportedGlobal", DataType="single", Unit="deg")  % Corrections for different bend angles of  cardan joint
  % beta=20:
  % [-108.882;-98.465;-88.121;-77.760;-67.297;-56.656;-45.782;-34.648;-23.266;-11.687;0.000;11.687;23.266;34.648;45.782;56.656;67.297;77.760;88.121;98.465;108.882]
  % beta=32.23 (E10):
  % [-107.1129464425101;-97.63102305040258;-88.30797648857715;-78.94952848352857;-69.36236179853692;-59.36108836533634;-48.78262483752904;-37.5134232095181;-25.5301161154706;-12.94118987975446;0;12.94118987975446;25.53011611547061;37.5134232095181;48.78262483752906;59.36108836533632;69.36236179853694;78.94952848352855;88.30797648857715;97.63102305040256;107.1129464425101]

motion_ratio_heave_front = Simulink.Parameter(0.61, DataType="single")  % MotionRatio Monoshock Front. Unit: unitless
  % This is the force ratio from the forces at the front
  % monoshock to the tire z-forces.

motion_ratio_heave_rear = Simulink.Parameter(0.61, DataType="single")  % MotionRatio Monoshock Rear. Unit: unitless
  % This is the force ratio from the forces at the rear
  % monoshock to the tire z-forces.

motion_ratio_roll_front = Simulink.Parameter(0.71, DataType="single")  % MotionRatio roll damper Front. Unit: unitless
  % This is the force ratio from the forces at the front
  % roll damper to the tire z-forces.

motion_ratio_roll_rear = Simulink.Parameter(0.71, DataType="single")  % MotionRatio roll damper Rear. Unit: unitless
  % This is the force ratio from the forces at the rear
  % roll damper to the tire z-forces.

damp_coef_heave_front_push = Simulink.Parameter([0.025 4000 2500], StorageClass="ExportedGlobal", DataType="single", Unit="N/(m/s)")  % damping coefficient of the front Monoshock while PUSHING.
  % Unit: kg/s bzw. N/(m/s)
  % [velocity at crinkle[in m/s], gradient at low speed[in N/(m/s^2)] , gradient at higher speed[in N/(m/s^2)]]

damp_coef_heave_rear_push = Simulink.Parameter([0.025 4000 2500], StorageClass="ExportedGlobal", DataType="single", Unit="N/(m/s)")  % damping coefficient of the rear Monoshock while PUSHING.
  % Unit: kg/s bzw. N/(m/s)
  % [velocity at crinkle[in m/s], gradient at low speed[in N/(m/s^2)] , gradient at higher speed[in N/(m/s^2)]]

damp_coef_heave_front_pull = Simulink.Parameter([0.025 3600 2000], StorageClass="ExportedGlobal", DataType="single", Unit="N/(m/s)")  % damping coefficient of the front Monoshock while PULLING.
  % Unit: kg/s bzw. N/(m/s)
  % [velocity at crinkle[in m/s], gradient at low speed[in N/(m/s^2)] , gradient at higher speed[in N/(m/s^2)]]

damp_coef_heave_rear_pull = Simulink.Parameter([0.025 3600 2000], StorageClass="ExportedGlobal", DataType="single", Unit="N/(m/s)")  % damping coefficient of the rear Monoshock while PULLING.
  % Unit: kg/s bzw. N/(m/s)
  % [velocity at crinkle[in m/s], gradient at low speed[in N/(m/s^2)] , gradient at higher speed[in N/(m/s^2)]]

spring_stiff_heave_front = Simulink.Parameter(157000, StorageClass="ExportedGlobal", DataType="single", Unit="N/m")  % spring stiffness of front monoshock. Unit: N/m
spring_stiff_heave_rear = Simulink.Parameter(166000, StorageClass="ExportedGlobal", DataType="single", Unit="N/m")  % spring stiffness of rear monoshock. Unit: N/m

damp_coef_roll_front_pull = Simulink.Parameter([0.04 4000 400], StorageClass="ExportedGlobal", DataType="single", Unit="N/(m/s)")  % damping coefficient of the front roll damper while PULLING.
  % Unit: kg/s bzw. N/(m/s)
  % [velocity at crinkle[in m/s], gradient at low speed[in N/(m/s^2)] , gradient at higher speed[in N/(m/s^2)]]

damp_coef_roll_front_push = Simulink.Parameter([0.03 6000 600], StorageClass="ExportedGlobal", DataType="single", Unit="N/(m/s)")  % damping coefficient of the front roll damper while PUSHING.
  % Unit: kg/s bzw. N/(m/s)
  % [velocity at crinkle[in m/s], gradient at low speed[in N/(m/s^2)] , gradient at higher speed[in N/(m/s^2)]]

tire_r_dyn = Simulink.Parameter(0.221, StorageClass="ExportedGlobal", DataType="single", Unit="m")  % Dynamic radius of the tire
  % E9: 0.221 (DV)
  % E10: 0.196

gearbox_ratio = Simulink.Parameter(13.5, DataType="single", Unit="1")

v2o_x = Simulink.Parameter(0.6, DataType="single", Unit="m")  % Distance between the Correvit sensor and CG in x direction of SAE-coordinate-system
  % Muss noch vermessen werden!
  % war positiv bei circa 0.6

x9DFrontX = Simulink.Parameter(0.7, DataType="single", Unit="m")  % coordinates of front 9D sensor in SAE x direction
x9DFrontY = Simulink.Parameter(0, DataType="single", Unit="m")  % coordinates of front 9D sensor in SAE y direction